# Grasshopper definition seg_04.07.gh (Grasshopper 1.0.7)
# plug-ins: OpenNest, Robot trajectory, Pufferfish

# ---- group: Input Tension
# Input Forces
# Input from rhino: Edit-Select object-By color
crv = Curve([<curve referenced from the Rhino model> x4034])

# ---- group: Input Compression
crv_2 = Curve([<curve referenced from the Rhino model> x5000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])

# ---- group: Input Geometry
# Input Geometry
rec = Rectangle({Plane=PlaneXY(3000.15, 93.6, 0), Size=Domain2(u=-3000.15..3000.15, v=-199.8..199.8)})

# ---- group: Reading Numbers / Tension values
# Input Force Values
id = Guid([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])

# ---- group: Reading Numbers / Compression values
# Input from rhino: Edit-Select object-Text
id_2 = Guid([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])

# ---- group: Reading Numbers
c_script = CSharpScript(id=id)  # -> out, text, plane; inputs id: Guid; disabled
# ---------- c_script: C# usings ----------
using System.IO;
using System.Linq;
using System.Data;
using System.Drawing;
using System.Reflection;
using System.Windows.Forms;
using System.Xml;
using System.Xml.Linq;
using System.Runtime.InteropServices;

using Rhino.DocObjects;
using Rhino.Collections;
using GH_IO;
using GH_IO.Serialization;
# ---------- c_script: C# ----------
    RhinoObject ro = RhinoDocument.Objects.Find(id);

    if(ro.ObjectType != ObjectType.Annotation) return;

    TextObject txt = ro as TextObject;

    text = txt.TextGeometry.Text;
    plane = txt.TextGeometry.Plane;
# ---------- end c_script ----------
c_script_2 = CSharpScript(id=id_2)  # -> out, text, plane; inputs id: Guid; disabled; same code as c_script
python = GhPythonScript(iValues=c_script.text)  # -> out, oMin; inputs iValues: list; disabled
# ---------- python: Python ----------
__author__ = "zhanshi"
__version__ = "2023.04.24"

import rhinoscriptsyntax as rs
import Rhino.Geometry as rg

min = iValues[0]
for i in iValues:
    if(i < min):
        min = i

oMin = min
# ---------- end python ----------
python_2 = GhPythonScript(iValues=c_script_2.text)  # -> out, oMax; inputs iValues: list; disabled
# ---------- python_2: Python ----------
__author__ = "zhanshi"
__version__ = "2023.04.24"

import rhinoscriptsyntax as rs
import Rhino.Geometry as rg

max = iValues[0]
for i in iValues:
    if(i > max):
        min = i

oMax = max
# ---------- end python_2 ----------

# ---- group: Cellular Model / Other shapes
crv_3 = Curve([<curve referenced from the Rhino model> x2])
crv_4 = Curve([<curve referenced from the Rhino model> x2])
crv_5 = Curve(<curve referenced from the Rhino model>)
crv_6 = Curve(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)
crv_7 = Curve(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)

crv_8 = Curve(<curve referenced from the Rhino model>)
crv_9 = Curve(<curve referenced from the Rhino model>)

# ---- group: Extra input tiles
einstein_tile = Curve([<curve referenced from the Rhino model> x31])  # disabled
crv_10 = Curve([<curve referenced from the Rhino model> x31])  # disabled

# ----
number_slider = Slider(0, range=0..100)  # disabled
number_slider_2 = Slider(0, range=0..100)  # disabled

# ---- group: Iteration
incr = Slider(1, range=0..10)  # disabled
panel = Panel("20")  # disabled
timer = Timer(Interval=10000, TimerInterval=10000, Target=counter)  # disabled
reset = Button()  # disabled
counter = PersistantPythonDataCounter(reset=reset, incr=incr, modVal=panel)  # -> i; inputs reset: Boolean, modVal: Int32; disabled
# ---------- counter: Python ----------
__author__ = "adapted by Joseph Oster from code by Dharman.Gersch"
__version__ = "2020Mar4"

ghenv.Component.Name = 'Persistant Python Data Counter'
ghenv.Component.NickName = 'Counter'
ghenv.Component.Message = ''
ghenv.Component.Category = 'Demo'
ghenv.Component.SubCategory = ''

import rhinoscriptsyntax as rs
import scriptcontext as sc

# Setup unique name to avoid conflicts with other instances of this component
# or anything else that may use global dictionary 'sticky'
unique_counter_key = "counter_"+str(ghenv.Component.InstanceGuid)

if sc.sticky.has_key(unique_counter_key): #retieve value from last loop
    i = (sc.sticky[unique_counter_key])
else:
    i = 0

ghenv.Component.Message = str(i)
i += incr

if reset or ((modVal is not None) and (i > modVal)):
    i = 0

sc.sticky[unique_counter_key] = i #save value for next loop
# ---------- end counter ----------
panel_2 = Panel(counter)  # disabled

# ----
crv_11 = Curve(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)  # disabled
area = Area(Geometry=crv_11)  # -> Area, Centroid; disabled

# ---- group: Nesting / LVL Plates(CNC Masse/ LVL Masse)
crv_12 = Curve(<curve referenced from the Rhino model>)  # disabled

# ----
incr_2 = Slider(0.1, range=0..10)  # disabled
timer_2 = Timer(Interval=-50, TimerInterval=50, Target=counter_2)  # disabled
panel_3 = Panel("21")  # disabled
reset_2 = Button()  # disabled
counter_2 = PersistantPythonDataCounter(reset=reset_2, incr=incr_2, modVal=panel_3)  # -> i; inputs reset: Boolean, modVal: Int32; disabled; same code as counter

# ----
# Data Sorting
panel_4 = Panel("0.1")
tol = GhPythonScript(iCompressions=crv_2, iTolerance=panel_4)  # -> out, oCurves; inputs iCompressions: list of Curve
# ---------- tol: Python ----------
__author__ = "zhanshi"
__version__ = "2023.04.24"

import rhinoscriptsyntax as rs
import Rhino.Geometry as rg

tolerance = iTolerance*0.5*100

#filter curves
useful_curves = []
for cur in iCompressions:
        length = cur.GetLength()
        if(length > tolerance):
            useful_curves.append(cur)

oCurves = useful_curves
# ---------- end tol ----------
midpt = CurveMiddle(Curve=tol.oCurves)
filtering = GhPythonScript(iTensions=crv, iTolerance="0.1")  # -> out, oTensions; inputs iTensions: list of Curve
# ---------- filtering: Python ----------
__author__ = "zhanshi"
__version__ = "2023.04.24"

import rhinoscriptsyntax as rs
import Rhino.Geometry as rg

tolerance = iTolerance*0.5*100

#filter curves
useful_curves = []
for cur in iTensions:
        length = cur.GetLength()
        if(length > tolerance):
            useful_curves.append(cur)

oTensions = useful_curves
# ---------- end filtering ----------

# ---- group: SLOWWWW
filtering_2 = GhPythonScript(iCompressions=tol.oCurves, iCentroids=midpt, iDif="0.5")  # -> out, oCompressions; inputs iCompressions: list of Curve, iCentroids: list of Point3d; disabled
# ---------- filtering_2: Python ----------
__author__ = "zhanshi"
__version__ = "2023.04.24"

import rhinoscriptsyntax as rs
import Rhino.Geometry as rg

#filter curves
useful_curves = []
for i in range(0, len(iCompressions)):
    pt = iCentroids[i]
    a = 0
    for j in range(0, len(iCompressions)):
        if(j != i):
            pt1 = iCompressions[j].PointAtEnd
            pt2 = iCompressions[j].PointAtStart
            dis1 = pt.DistanceTo(pt1)
            dis2 = pt.DistanceTo(pt2)
            if(dis1 < iDif or dis2 < iDif):
                a = 1
                break
    if(a == 0):
        useful_curves.append(iCompressions[i])

oCompressions = useful_curves
# ---------- end filtering_2 ----------
crv_13 = Curve([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])

# ----
flip = GhPythonScript(iCur=crv_13)  # -> out, oCompressions; inputs iCur: list of Curve
# ---------- flip: Python ----------
__author__ = "zhanshi"
__version__ = "2023.05.11"

import rhinoscriptsyntax as rs
import Rhino.Geometry as rg

list = []

for cur in iCur:
    if(cur.PointAtStart.X<cur.PointAtEnd.X):
        rg.Curve.Reverse(cur)
    list.append(cur)

oCompressions = list
# ---------- end flip ----------

# ---- group: Input data sorting
midpt_2 = CurveMiddle(Curve=filtering.oTensions)
end = EndPoints(Curve=filtering.oTensions)  # -> Start, End
midpt_3 = CurveMiddle(Curve=flip.oCompressions)
end_2 = EndPoints(Curve=flip.oCompressions)  # -> Start, End
vec2pt = Vector2Pt(PointA=end.Start, PointB=end.End, Unitize=False)  # -> Vector, Length
vec2pt_2 = Vector2Pt(PointA=end_2.Start, PointB=end_2.End, Unitize=False)  # -> Vector, Length

# ----
vdisex = VectorDisplayEx(Point=midpt_2, Vector=vec2pt.Vector, Colour=RGBA(0, 0, 255, 162), Width=2)
vdisex_2 = VectorDisplayEx(Point=end_2.Start, Vector=vec2pt_2.Vector, Colour=RGBA(240, 15, 0, 141), Width=2)

# ---- group: Cellular Model
# Cellular Models Rectangle
number_slider_3 = Slider(700, range=1..1000)
cellularmodel_c = GhPythonScript(
    iCurve=rec,
    iteration=Slider(7, range=1..20),
    iDiviation=Slider(0.2, range=0..1),
    iCVectors=vec2pt_2.Vector,
    iCLocations=midpt_3,
    iTVectors=vec2pt.Vector,
    iTLocations=midpt_2,
    iGetProcess=Toggle(False),
    minSize=Slider(100, range=1..1000),
    maxSize=number_slider_3,
    iSingleMa=Toggle(False),
    iMaDif=Slider(200, range=1..1000))  # -> out, oResult, oVectors, oProcess, oPLabels, oMLabels; inputs iCurve: Rectangle3d, iteration: Int32, iCVectors: list of Vector3d, iCLocations: list of Point3d, iTVectors: list of Vector3d, iTLocations: list of Point3d, iGetProcess: Boolean, iSingleMa: Boolean
# ---------- cellularmodel_c: Python ----------
__author__ = "zhanshi"
__version__ = "2023.05.22"

import rhinoscriptsyntax as rs
import Rhino.Geometry as rg

class Cell:
    countCells = 0
    
    def __init__(self, i, width, height, center):
        self.i = i
        self.width = width
        self.height = height
        self.center = center
        self.Cdiv = None
        self.Tdiv = None
        Cell.countCells += 1
        self.Cforce = None
        self.Tforce = None
        self.CinCount = 0
        self.TinCount = 0
        self.material = 'P'
        self.boundingBox = rg.BoundingBox(rg.Point3d(self.center.X - 0.5*self.width, self.center.Y - 0.5*self.height, self.center.Z), rg.Point3d(self.center.X + 0.5*self.width, self.center.Y + 0.5*self.height, self.center.Z))
    
    def calculateDiv(self, iVectors, iLocations, Com):
        if(Com):
            if(self.Cdiv is None):
                if(self.Cforce is None):
                    self.computeVector(iVectors, iLocations, Com)
                div = 0
                count = 0
                for i in range(len(iLocations)):
                    pt = iLocations[i]
                    if(self.boundingBox.Contains(pt)):
                        div += rg.Vector3d.VectorAngle(iVectors[i], self.Cforce)
                        count += 1
                self.Cdiv = div
                self.CinCount = count
                return div
            else:
                return self.Cdiv
        else:
            if(self.Tdiv is None):
                if(self.Tforce is None):
                    self.computeVector(iVectors, iLocations, Com)
                div = 0
                count = 0
                for i in range(len(iLocations)):
                    pt = iLocations[i]
                    if(self.boundingBox.Contains(pt)):
                        div += rg.Vector3d.VectorAngle(iVectors[i], self.Tforce)
                        count += 1
                self.Tdiv = div
                self.TinCount = count
                return div
            else:
                return self.Tdiv
    
    def computeVector(self, iVectors, iLocations, Com):
        if(Com):
            if(self.Cforce is None):
                sumLength = 0
                for i in range(0, len(iVectors)):
                    pt = iLocations[i]
                    if(self.boundingBox.Contains(pt)):
                        sumLength += iVectors[i].Length
                aveVec = iVectors[0] * iVectors[0].Length / sumLength
                for i in range(1, len(iVectors)):
                    pt = iLocations[i]
                    if(self.boundingBox.Contains(pt)):
                        factor = iVectors[i].Length / sumLength
                        aveVec += iVectors[i] * factor
                self.Cforce = aveVec
                return aveVec
            else:
                return self.Cforce
        else:
            if(self.Tforce is None):
                sumLength = 0
                for i in range(0, len(iVectors)):
                    pt = iLocations[i]
                    if(self.boundingBox.Contains(pt)):
                        sumLength += iVectors[i].Length
                aveVec = iVectors[0] * iVectors[0].Length / sumLength
                for i in range(1, len(iVectors)):
                    pt = iLocations[i]
                    if(self.boundingBox.Contains(pt)):
                        factor = iVectors[i].Length / sumLength
                        aveVec += iVectors[i] * factor
                self.Tforce = aveVec
                return aveVec
            else:
                return self.Tforce
    
    def getShape(self):
        return rg.Rectangle3d(rg.Plane(self.center, rg.Vector3d(0,0,1)), rg.Point3d(self.center.X - 0.5*self.width, self.center.Y - 0.5*self.height, self.center.Z), rg.Point3d(self.center.X + 0.5*self.width, self.center.Y + 0.5*self.height, self.center.Z))
    
    def subdivide(self):
        list = []
        if(self.height > self.width):
            newCenter1 = rg.Point3d(self.center.X, self.center.Y - 0.5*0.5*self.height, self.center.Z)
            newCenter2 = rg.Point3d(self.center.X, self.center.Y + 0.5*0.5*self.height, self.center.Z)
            cell1 = Cell(self.i+1, self.width, self.height*0.5, newCenter1)
            cell2 = Cell(self.i+1, self.width, self.height*0.5, newCenter2)
            list.append(cell1)
            list.append(cell2)
        else:
            newCenter1 = rg.Point3d(self.center.X - 0.5*0.5*self.width, self.center.Y, self.center.Z)
            newCenter2 = rg.Point3d(self.center.X + 0.5*0.5*self.width, self.center.Y, self.center.Z)
            cell1 = Cell(self.i+1, self.width*0.5, self.height, newCenter1)
            cell2 = Cell(self.i+1, self.width*0.5, self.height, newCenter2)
            list.append(cell1)
            list.append(cell2)
        return list
    
    def isStable(self):
        if(self.height >= maxSize or self.width >= maxSize):
            return False
        if(self.height >= self.width):
            if(self.height*0.5 < minSize):
                return True
            else:
                return (self.Cdiv <= iDiviation*self.CinCount and self.Tdiv <= iDiviation*self.TinCount)
        else:
            if(self.width*0.5 < minSize):
                return True
            else:
                return (self.Cdiv and self.Tdiv <= iDiviation*self.TinCount)
    
    def getForce(self, iSiMa, iMa):
        # if reach iDiviation?
        # if reach size limitation?
        if(self.Cforce is None):
            self.computeVector(iCVectors, iCLocations, True)
        if(self.Tforce is None):
            self.computeVector(iTVectors, iTLocations, False)
        sum = self.Cforce.Length + self.Tforce.Length
        newForce = self.Cforce*self.Cforce.Length/sum + self.Tforce*self.Tforce.Length/sum 
        if(iSiMa):
            return newForce
        else:
            if(self.Cforce.Length >= self.Tforce.Length):
                if(self.Tforce.Length >= iMa):
                    self.material = 'C'
            else:
                if(self.Cforce.Length >= iMa):
                    self.material = 'C'
            return newForce

List = []
vList = []
mList = []
OutList = []

for i in range(iteration):
    if(Cell.countCells == 0):
        #first cell
        cell0 = Cell(0, iCurve.Width, iCurve.Height, iCurve.Center)
        List.append(cell0)
        cell0.calculateDiv(iCVectors, iCLocations, True)
        cell0.calculateDiv(iTVectors, iTLocations, False)
    else:
        for j in range(len(List)):
            if(List[j].i == (i-1)):
                if(List[j].isStable()):
                    newCell = Cell(List[j].i+1, List[j].width, List[j].height, List[j].center)
                    List.append(newCell)
                else:
                    newCells = List[j].subdivide()
                    newCells[0].calculateDiv(iCVectors, iCLocations, True)
                    newCells[0].calculateDiv(iTVectors, iTLocations, False)
                    newCells[1].calculateDiv(iCVectors, iCLocations, True)
                    newCells[1].calculateDiv(iTVectors, iTLocations, False)
                    List.append(newCells[0])
                    List.append(newCells[1])
    if(i == iteration-1):
        for j in range(len(List)):
            if(List[j].i == i):
                OutList.append(List[j].getShape())
                vList.append(List[j].getForce(iSingleMa, iMaDif))
                mList.append(List[j].material)

oResult = OutList
oVectors = vList
oMLabels = mList

if(iGetProcess):
    list = []
    labels = []
    for i in range(len(List)):
        list.append(List[i].getShape())
        labels.append(List[i].i)
    oProcess = list
    oPLabels = labels
# ---------- end cellularmodel_c ----------
rec_2 = Rectangle(cellularmodel_c.oResult)
vec = Vector(cellularmodel_c.oVectors)
pcen = PolygonCenter(Polyline=rec_2)  # -> CenterV, CenterE, CenterA
text = Text(Location=pcen.CenterV, Text=cellularmodel_c.oMLabels, Size=100)
vdis = VectorDisplay(Anchor=pcen.CenterV, Vector=vec)

# Cellular Models Polygon
number_slider_4 = Slider(500, range=1..1000)
crv_14 = Curve(rec)
topoly = CurveToPolyline(Curve=crv_14, ToleranceDistance=0, ToleranceAngle=0)  # -> Polyline, Segments
cellularmodel_c_2 = GhPythonScript(
    iPolyline=topoly.Polyline,
    iteration=Slider(6, range=1..20),
    iDiviation=Slider(0.2, range=0..1),
    iCVectors=vec2pt_2.Vector,
    iCLocations=midpt_3,
    iTVectors=vec2pt.Vector,
    iTLocations=midpt_2,
    minHeight=Slider(100, range=1..1000),
    minWidth=Slider(100, range=1..1000),
    maxHeight=number_slider_4,
    maxWidth=Slider(600, range=1..1000),
    iSingleMa=Toggle(True),
    iMaDif=Slider(200, range=1..1000),
    iStaggering=Toggle(False))  # -> out, oResult, oVectors, oMLabels; inputs iPolyline: Polyline, iteration: Int32, iCVectors: list of Vector3d, iCLocations: list of Point3d, iTVectors: list of Vector3d, iTLocations: list of Point3d, iSingleMa: Boolean, iStaggering: Boolean; disabled
# ---------- cellularmodel_c_2: Python ----------
import Rhino.Geometry as rg
import copy
import math

class Cell:
    
    countCells = 0
    countStable = 0
    
    def __init__(self, i, Vertices, Stable):
        self.i = i
        self.vertices = Vertices
        self.Cdiv = None
        self.Tdiv = None
        Cell.countCells += 1
        self.Cforce = None
        self.Tforce = None
        self.CinLength = 0
        self.TinLength = 0
        self.material = True #"P"
        self.shape = rg.PolylineCurve(self.vertices)
        self.stable = Stable
        if(Stable):
            Cell.countStable += 1

    def computeVector(self, iVectors, iLocations, Com):
        if(Com):
            if(self.Cforce is None):
                sumLength = iVectors[0].Length
                sumVec = iVectors[0] * iVectors[0].Length
                for i in xrange(1, len(iVectors)):
                    pt = iLocations[i]
                    if(self.shape.Contains(pt) == rg.PointContainment.Inside):
                        sumLength += iVectors[i].Length
                        sumVec += iVectors[i] * iVectors[i].Length
                self.CinLength = sumLength
                self.Cforce = sumVec / sumLength
            return self.Cforce
        else:
            if(self.Tforce is None):
                sumLength = iVectors[0].Length
                sumVec = iVectors[0] * iVectors[0].Length
                for i in xrange(1, len(iVectors)):
                    pt = iLocations[i]
                    if(self.shape.Contains(pt) == rg.PointContainment.Inside):
                        sumLength += iVectors[i].Length
                        sumVec += iVectors[i] * iVectors[i].Length
                self.TinLength = sumLength
                self.Tforce = sumVec / sumLength
            return self.Tforce
    
    def calculateDiv(self, iVectors, iLocations, Com):
        if(Com):
            if(self.Cdiv is None):
                if(self.Cforce is None):
                    self.computeVector(iVectors, iLocations, Com)
                div = 0
                count = 0
                for i in xrange(len(iLocations)):
                    pt = iLocations[i]
                    if(self.shape.Contains(pt) == rg.PointContainment.Inside):
                        div += rg.Vector3d.VectorAngle(iVectors[i], self.Cforce)
                        count += 1
                if(count == 0):
                    return
                self.Cdiv = div / count
                return div
            else:
                return self.Cdiv
        else:
            if(self.Tdiv is None):
                if(self.Tforce is None):
                    self.computeVector(iVectors, iLocations, Com)
                div = 0
                count = 0
                for i in xrange(len(iLocations)):
                    pt = iLocations[i]
                    if(self.shape.Contains(pt) == rg.PointContainment.Inside):
                        div += rg.Vector3d.VectorAngle(iVectors[i], self.Tforce)
                        count += 1
                if(count == 0):
                    return
                self.Tdiv = div / count
                return div
            else:
                return self.Tdiv
    
    def subdivide(self):
        print(Cell.countCells,"--------------")
        oriLines = list(self.shape.ToPolyline().GetSegments())
        lines = list(self.shape.ToPolyline().GetSegments())
        def getLength(line):
            return line.Length
        lines.sort(key=getLength)
        for l in lines:
            print(l.Length)
        #Longest edge
        foundLine = oriLines[oriLines.index(lines[-1])]
        print(oriLines.index(lines[-1]), "INDEXFOUND" )
        print(foundLine.From)
        midP = foundLine.PointAt(0.50000)
        print(foundLine.Length == lines[-1].Length)
        angle = math.degrees(rg.Vector3d.VectorAngle(foundLine.Direction, rg.Vector3d(1.0,.0,.0)))
        #see which direction
        cutterBox = rg.BoundingBox(rg.Point3d(.0,.0,.0), rg.Point3d(1.0,.0,.0))
        newList= []
        if(angle < 45 or (angle >135 and angle <=180)):
            #subdivide with y axis
            cutterBox = rg.BoundingBox(rg.Point3d(midP.X, midP.Y-10000, midP.Z-100), rg.Point3d(midP.X+10000, midP.Y+10000, midP.Z+100))
            print("X")
        else:
            #subdivide with x axis
            cutterBox = rg.BoundingBox(rg.Point3d(midP.X-10000, midP.Y, midP.Z-100), rg.Point3d(midP.X+10000, midP.Y-10000, midP.Z+100))
            print(cutterBox, "Y")
        #a.append(cutterBox)
        cutter = cutterBox.ToBrep()
        subDivLines = self.shape.Split(cutter, 0.001)
        for l in subDivLines:
            ptList = []
            for seg in l.ToPolyline().GetSegments():
                ptList.append(seg.From)
            ptList.append(l.PointAtEnd)
            ptList.append(l.PointAtStart)
            newList.append(ptList)
        cell1 = Cell(self.i+1, newList[0], self.stable)
        cell2 = Cell(self.i+1, newList[1], self.stable)
        result = [cell1, cell2]
        Cell.countCells -= 1
        return result
    
    def isStable(self, maxH, maxW, minH, minW, iDiv):
        if(self.stable):
            return True
        else:
            #Size limitation
            box = self.shape.ToPolyline().BoundingBox
            pt1 = box.Corner(True, True, True)
            pt2 = box.Corner(False, False, False)
            height = pt2.Y-pt1.Y
            width = pt2.X-pt1.X
            if(height >= maxH or width >= maxW):
                return False
            else:
                #Diviation fulfill?
                if(self.Cdiv <= iDiv and self.Tdiv <= iDiv):
                    self.stable = True
                    Cell.countStable += 1
                    return True
                if(width < minW or height < minH):
                    self.stable = True
                    Cell.countStable += 1
                    return True
                return False
    
    def getForce(self, iSiMa, iMa):
        # if reach iDiviation?
        # if reach size limitation?
        #only one Type of force
        
        if(self.TinLength == 0):
            newForce = self.Cforce
        elif(self.CinLength == 0):
            newForce = self.Tforce
        else:
            sum = self.CinLength + self.TinLength
            newForce = self.Cforce*self.CinLength/sum + self.Tforce*self.TinLength/sum
        if(iSiMa):
            return newForce
        else:
            if(self.Cforce.Length >= self.Tforce.Length):
                if(self.Tforce.Length >= iMa):
                    self.material = False #"C"
            else:
                if(self.Cforce.Length >= iMa):
                    self.material = False #"C"
        return newForce



List = []
vList = []
mList = []
OutList = []



#first cell
ptList = []
segs = iPolyline.GetSegments()
a = []

for l in segs:
    cur = l.ToNurbsCurve()
    ptList.append(rg.Point3d(l.PointAt(0).X, l.PointAt(0).Y,l.PointAt(0).Z))
ptList.append(rg.Point3d(segs[0].PointAt(0).X, segs[0].PointAt(0).Y,segs[0].PointAt(0).Z))

cell0 = Cell(0, ptList, False)
List.append(cell0)
cell0.calculateDiv(iCVectors, iCLocations, True)
cell0.calculateDiv(iTVectors, iTLocations, False)

#Iteration
for i in xrange(iteration):
    for j in xrange(len(List)):
        if(List[j].i == (i-1)):
            if(List[j].isStable(maxHeight, maxWidth, minHeight, minWidth, iDiviation)):
                newCell = Cell(List[j].i+1, List[j].vertices, List[j].stable)
                newCell.calculateDiv(iCVectors, iCLocations, True)
                newCell.calculateDiv(iTVectors, iTLocations, False)
                List.append(newCell)
            else:
                newCells = List[j].subdivide()
                newCells[0].calculateDiv(iCVectors, iCLocations, True)
                newCells[0].calculateDiv(iTVectors, iTLocations, False)
                newCells[1].calculateDiv(iCVectors, iCLocations, True)
                newCells[1].calculateDiv(iTVectors, iTLocations, False)
                List.append(newCells[0])
                List.append(newCells[1])
    if(i == iteration-1 or Cell.countCells == Cell.countStable):
        print("ite", i)
        for j in xrange(len(List)):
            if(List[j].i == i):
                OutList.append(List[j].shape)
                vList.append(List[j].getForce(iSingleMa, iMaDif))
                List[j].calculateDiv(iCVectors, iCLocations, True)
                List[j].calculateDiv(iTVectors, iTLocations, False)
                mList.append(List[j].material)
        break

#out
oResult = OutList
oVectors = vList
oMLabels = mList
# ---------- end cellularmodel_c_2 ----------

# ---- group: Extra input tiles
# External Input
faceb = FaceBoundaries()  # -> flatten(Boundaries); disabled
crv_15 = Curve()  # disabled
einstein_tile_2 = Curve([<curve referenced from the Rhino model> x118])  # disabled
end_3 = EndPoints(Curve=flip.oCompressions)  # -> Start, End; disabled
end_4 = EndPoints(Curve=filtering.oTensions)  # -> Start, End; disabled
incurve = PointInCurve(Point=midpt_3, Curve=graft(faceb))  # -> simplify(Relationship), Point; disabled
incurve_2 = PointInCurve(Point=midpt_2, Curve=graft(faceb))  # -> simplify(Relationship), Point; disabled
vec2pt_3 = Vector2Pt(PointA=end_3.Start, PointB=end_3.End, Unitize=False)  # -> Vector, Length; disabled
vec2pt_4 = Vector2Pt(PointA=end_4.Start, PointB=end_4.End, Unitize=False)  # -> Vector, Length; disabled
caverage = GhPythonScript(iPoints=incurve.Relationship, iForces=flip.oCompressions, iVectors=vec2pt_3.Vector)  # -> out, flatten(oAveForces); inputs iPoints: list of Int32, iForces: list of Curve, iVectors: list of Vector3d; disabled
# ---------- caverage: Python ----------
__author__ = "zhanshi"
__version__ = "2023.04.28"

import rhinoscriptsyntax as rs
import Rhino.Geometry as rg

tempVal = []
tempVec = []

for i in range(0, len(iPoints)):
    if(iPoints[i] == 2):
        tempVal.append(iForces[i])
        tempVec.append(iVectors[i])

if(len(tempVal)>1):
    sumLength = 0
    for i in range(0, len(tempVal)):
        sumLength += tempVal[i].GetLength()
    aveVec = tempVec[0] * tempVal[0].GetLength() / sumLength
    for i in range(1, len(tempVec)):
        factor = tempVal[i].GetLength() / sumLength
        aveVec +=  tempVec[i] * factor
    oAveForces = aveVec

if(len(tempVal)==1):
    oAveForces = tempVec[0]

oGroups = tempVal
# ---------- end caverage ----------
taverage = GhPythonScript(iPoints=incurve_2.Relationship, iForces=filtering.oTensions, iVectors=vec2pt_4.Vector)  # -> out, flatten(oAveForces); inputs iPoints: list of Int32, iForces: list of Curve, iVectors: list of Vector3d; disabled; same code as caverage
panel_5 = Panel("0.8")  # disabled
average = GhPythonScript(iTForces=taverage.oAveForces, iTiles=faceb, iCForces=caverage.oAveForces, iDif=panel_5)  # -> out, oTiles, oAveForces; inputs iTForces: list of Vector3d, iTiles: list of Curve, iCForces: list of Vector3d; disabled
# ---------- average: Python ----------
__author__ = "zhanshi"
__version__ = "2023.04.28"

import rhinoscriptsyntax as rs
import Rhino.Geometry as rg

tempGeo = []
tempVec = []

for i in range(0, len(iTiles)):
    if((iTForces[i] != None) and (iCForces[i] != None)):
        dif= abs(iTForces[i].Length-iCForces[i].Length)/(iTForces[i].Length+iCForces[i].Length)
        if(dif > iDif):
            if(iTForces[i].Length < iCForces[i].Length):
                tempVec.append(iCForces[i])
            else:
                tempVec.append(iTForces[i])
        else:
            sumLen = iTForces[i].Length + iCForces[i].Length
            vec = iTForces[i]*iTForces[i].Length/sumLen + iCForces[i]*iCForces[i].Length/sumLen 
            tempVec.append(vec)
        tempGeo.append(iTiles[i])
    elif((iTForces[i] == None) and (iCForces[i] != None)):
        tempGeo.append(iTiles[i])
        tempVec.append(iCForces[i])
    elif((iTForces[i] != None) and (iCForces[i] == None)):
        tempGeo.append(iTiles[i])
        tempVec.append(iTForces[i])

oTiles = tempGeo
oAveForces = tempVec
# ---------- end average ----------

# ----
pcen_2 = PolygonCenter(Polyline=average.oTiles)  # -> CenterV, CenterE, CenterA; disabled
vdis_2 = VectorDisplay(Anchor=pcen_2.CenterV, Vector=taverage.oAveForces)  # disabled
vdis_3 = VectorDisplay(Anchor=pcen_2.CenterV, Vector=caverage.oAveForces)  # disabled
vdisex_3 = VectorDisplayEx(Point=pcen_2.CenterV, Vector=caverage.oAveForces, Colour=RGBA(240, 15, 0, 141), Width=2)  # disabled
vdisex_4 = VectorDisplayEx(Point=pcen_2.CenterV, Vector=taverage.oAveForces, Colour=RGBA(0, 0, 255, 162), Width=2)  # disabled
vdisex_5 = VectorDisplayEx(Point=pcen_2.CenterV, Vector=average.oAveForces, Colour=RGBA(3, 170, 0, 162), Width=2)  # disabled

# ---- group: Cellular Model
# Cellular Models Curve with Cutout
number_slider_5 = Slider(4, range=1..20)
boundary = BoundarySurfaces(Edges=crv_3)
crv_16 = Curve(rec)
brep = Brep(boundary)
cellularmodel_c_3 = GhPythonScript(
    iBoundary=brep,
    iteration=Slider(7, range=1..20),
    iDiviation=Slider(0.2, range=0..1),
    iCVectors=vec2pt_2.Vector,
    iCLocations=midpt_3,
    iTVectors=vec2pt.Vector,
    iTLocations=midpt_2,
    minHeight=Slider(100, range=1..1000),
    minWidth=Slider(100, range=1..1000),
    maxHeight=Slider(500, range=1..1000),
    maxWidth=Slider(600, range=1..1000),
    iSingleMa=Toggle(True),
    iMaDif=Slider(200, range=1..1000),
    iStaggering=Toggle(False),
    iLayers=Slider(2, range=1..10),
    iSeed=number_slider_5)  # -> out, oCurves, oLayers, oVectors, oMLabels, oBreps, oSavedPos; inputs iBoundary: Brep, iteration: Int32, iCVectors: list of Vector3d, iCLocations: list of Point3d, iTVectors: list of Vector3d, iTLocations: list of Point3d, iSingleMa: Boolean, iStaggering: Boolean, iLayers: Int32, iSeed: Int32
# ---------- cellularmodel_c_3: Python ----------
import Rhino.Geometry as rg
import copy
import math
import Rhino
import random

class Cell:
    
    count = 0
    countCells = 0
    countStable = 0
    divPositions = rg.PointCloud()
    
    def __init__(self, i, Brep, Stable, Layer):
        self.i = i
        self.Cdiv = None
        self.Tdiv = None
        Cell.countCells += 1
        self.Cforce = None
        self.Tforce = None
        self.CinLength = 0
        self.TinLength = 0
        self.material = True #"P"
        self.shape = Brep
        self.stable = Stable
        self.layer = Layer
        if(Stable):
            Cell.countStable += 1
        self.ID = Cell.count
        Cell.count += 1

    def computeVector(self, iVectors, iLocations, Com):
        if(Com):
            if(self.Cforce is None):
                sumLength = 0
                sumVec = rg.Vector3d(.0,.0,.0)
                for i in range(0, len(iVectors)):
                    pt = iLocations[i]
                    cPt = self.shape.ClosestPoint(pt)
                    dis = pt.DistanceTo(cPt)
                    if(dis < 0.1):
                        sumLength += iVectors[i].Length
                        sumVec += iVectors[i] * iVectors[i].Length
                self.CinLength = sumLength
                self.Cforce = sumVec / sumLength
            return self.Cforce
        else:
            if(self.Tforce is None):
                sumLength = 0
                sumVec = rg.Vector3d(.0,.0,.0)
                for i in range(0, len(iVectors)):
                    pt = iLocations[i]
                    cPt = self.shape.ClosestPoint(pt)
                    dis = pt.DistanceTo(cPt)
                    if(dis < 0.1):
                        sumLength += iVectors[i].Length
                        sumVec += iVectors[i] * iVectors[i].Length
                self.TinLength = sumLength
                self.Tforce = sumVec / sumLength
            return self.Tforce
    
    def calculateDiv(self, iVectors, iLocations, Com):
        if(Com):
            if(self.Cdiv is None):
                if(self.Cforce is None):
                    self.computeVector(iVectors, iLocations, Com)
                div = 0
                count = 0
                for i in range(len(iLocations)):
                    pt = iLocations[i]
                    cPt = self.shape.ClosestPoint(pt)
                    dis = pt.DistanceTo(cPt)
                    if(dis < 0.1):
                        div += rg.Vector3d.VectorAngle(iVectors[i], self.Cforce)
                        count += 1
                if(count == 0):
                    return
                self.Cdiv = div / count
                return div
            else:
                return self.Cdiv
        else:
            if(self.Tdiv is None):
                if(self.Tforce is None):
                    self.computeVector(iVectors, iLocations, Com)
                div = 0
                count = 0
                for i in range(len(iLocations)):
                    pt = iLocations[i]
                    cPt = self.shape.ClosestPoint(pt)
                    dis = pt.DistanceTo(cPt)
                    if(dis < 0.1):
                        div += rg.Vector3d.VectorAngle(iVectors[i], self.Tforce)
                        count += 1
                if(count == 0):
                    return
                self.Tdiv = div / count
                return div
            else:
                return self.Tdiv
    
    def findReplacingPoint(self, Pt, dividedInY):
        ePTIndex = Cell.divPositions.ClosestPoint(Pt)
        if(ePTIndex != -1):
            ePT = Cell.divPositions.PointAt(ePTIndex)
            if(dividedInY):
                eDis = abs(ePT.X-Pt.X)
            else:
                eDis = abs(ePT.Y-Pt.Y)
            if(eDis <= 10 and (Cell.divPositions.GetUserString(ePT.GetHashCode().ToString()) == self.layer.ToString())):
                return ePT
            else:
                return Pt
        else:
            return Pt
    
    def subdivide(self):
        #Find Longest edge
        count = 0
        i = self.shape.Edges.GetEnumerator()
        curves = []
        while(count < self.shape.Edges.Count):
            curves.append(next(i).EdgeCurve)
            count += 1
        orCurves = copy.copy(curves)
        def getLength(curve):
            return curve.GetLength()
        curves.sort(key=getLength)
        foundCurve = orCurves[orCurves.index(curves[-1])]
        angle = math.degrees(rg.Vector3d.VectorAngle(foundCurve.TangentAtStart, rg.Vector3d(1.0,.0,.0)))
        midPt = foundCurve.PointAtNormalizedLength(0.5)
        #check mid point in existing point cloud
        nPtIndex = Cell.divPositions.ClosestPoint(midPt)
        needToShift = False
        if(nPtIndex != -1):
            nPT = Cell.divPositions.PointAt(nPtIndex)
            # check distance in both directions
            if(angle < 45 or (angle >135 and angle <=180)):
                nDis = abs(nPT.X-midPt.X)
            else:
                nDis = abs(nPT.Y-midPt.Y)
            if(Cell.divPositions.GetUserString(nPT.GetHashCode().ToString()) == self.layer.ToString()):
                # same layer: use the existing position - after finding the splitting points
                if(nDis <= 25):
                    midPt = nPT
            else:
                # different layer: shift the point for the cutter
                if(nDis <= 50):
                    needToShift = True
        #see which direction for cutter
        cutterBox = rg.BoundingBox(rg.Point3d(.0,.0,.0), rg.Point3d(1.0,.0,.0))
        newList= []
        dividedInY = False
        random.seed(iSeed)
        if(angle < 45 or (angle >135 and angle <=180)):
            #subdivide with y axis
            dividedInY = True
            if(needToShift):
                midPt += rg.Vector3d(foundCurve.GetLength()*(random.uniform(0.15, 0.20)*random.choice([1, -1])), .0,.0)
                midPt = self.findReplacingPoint(midPt, dividedInY)
            cutterBox = rg.BoundingBox(rg.Point3d(midPt.X, midPt.Y-10000, midPt.Z-100), rg.Point3d(midPt.X+10000, midPt.Y+10000, midPt.Z+100))
        else:
            #subdivide with x axis
            if(needToShift):
                midPt += rg.Vector3d(.0, foundCurve.GetLength()*(random.uniform(0.1, 0.15)*random.choice([1, -1])), .0)
                midPt = self.findReplacingPoint(midPt, dividedInY)
            cutterBox = rg.BoundingBox(rg.Point3d(midPt.X-10000, midPt.Y, midPt.Z-100), rg.Point3d(midPt.X+10000, midPt.Y-10000, midPt.Z+100))
        cutter = cutterBox.ToBrep()
        subDivBreps = self.shape.Split(cutter, 0.00001)
        #Find the splitting points and save them
        count = 0
        i = self.shape.Vertices.GetEnumerator()
        VList = Rhino.Collections.Point3dList()
        while(count < self.shape.Vertices.Count):
            VList.Add(next(i).Location)
            count += 1
        sBrep = subDivBreps[0]
        count = 0
        i = sBrep.Vertices.GetEnumerator()
        sList = []
        # get the splitting points
        while(count < sBrep.Vertices.Count):
            v = next(i)
            if(VList.Contains(v.Location) == False):
                sList.append(v.Location)
            count += 1
        # see if cut again
        cutAgain = False
        for sPt in sList:
            sPTIndex = Cell.divPositions.ClosestPoint(sPt)
            if(sPTIndex != -1):
                sPT = Cell.divPositions.PointAt(sPTIndex)
                if(dividedInY):
                    sDis = abs(sPT.X-sPt.X)
                else:
                    sDis = abs(sPT.Y-sPt.Y)
                #same layer
                if(sDis < 50 and (Cell.divPositions.GetUserString(sPT.GetHashCode().ToString()) == self.layer.ToString())):
                    midPt = self.midPt = self.findReplacingPoint(sPT, dividedInY)
                    if(dividedInY):
                        cutterBox = rg.BoundingBox(rg.Point3d(midPt.X, midPt.Y-10000, midPt.Z-100), rg.Point3d(midPt.X+10000, midPt.Y+10000, midPt.Z+100))
                    else:
                        cutterBox = rg.BoundingBox(rg.Point3d(midPt.X-10000, midPt.Y, midPt.Z-100), rg.Point3d(midPt.X+10000, midPt.Y-10000, midPt.Z+100))
                    cutAgain = True
                    print("cutAgain", self.ID)
                #different layer
                elif(sDis < 50 and (Cell.divPositions.GetUserString(sPT.GetHashCode().ToString()) != self.layer.ToString())):
                    midPt = sPT
                    if(dividedInY):
                        midPt += rg.Vector3d(foundCurve.GetLength()*(random.uniform(0.1, 0.15)*random.choice([1, -1])), .0,.0)
                        midPt = self.findReplacingPoint(sPT, dividedInY)
                        cutterBox = rg.BoundingBox(rg.Point3d(midPt.X, midPt.Y-10000, midPt.Z-100), rg.Point3d(midPt.X+10000, midPt.Y+10000, midPt.Z+100))
                    else:
                        midPt += rg.Vector3d(.0, foundCurve.GetLength()*(random.uniform(0.1, 0.15)*random.choice([1, -1])), .0)
                        midPt = self.findReplacingPoint(sPT, dividedInY)
                        cutterBox = rg.BoundingBox(rg.Point3d(midPt.X-10000, midPt.Y, midPt.Z-100), rg.Point3d(midPt.X+10000, midPt.Y-10000, midPt.Z+100))
                    cutAgain = True
        if(cutAgain):
            cutter = cutterBox.ToBrep()
            subDivBreps = self.shape.Split(cutter, 0.00001)
            sBrep = subDivBreps[0]
            count = 0
            i = sBrep.Vertices.GetEnumerator()
            sList = []
            # get the splitting points
            while(count < sBrep.Vertices.Count):
                v = next(i)
                if(VList.Contains(v.Location) == False):
                    sList.append(v.Location)
                count += 1
        for sPt in sList:
            sPtIndex = Cell.divPositions.ClosestPoint(sPt)
            if(sPtIndex != -1):
                sPT = Cell.divPositions.PointAt(sPtIndex)
                sDis = sPt.DistanceTo(sPT)
                if(sDis > 10):
                    Cell.divPositions.SetUserString(sPt.GetHashCode().ToString(), self.layer.ToString())
                    Cell.divPositions.Add(sPt)
            else:
                Cell.divPositions.SetUserString(sPt.GetHashCode().ToString(), self.layer.ToString())
                Cell.divPositions.Add(sPt)
        #new cells
        cell1 = Cell(self.i+1, subDivBreps[0], self.stable, self.layer)
        cell2 = Cell(self.i+1, subDivBreps[1], self.stable, self.layer)
        result = [cell1, cell2]
        Cell.countCells -= 1
        return result
    
    def isStable(self, maxH, maxW, minH, minW, iDiv):
        if(self.stable):
            return True
        else:
            #Size limitation
            box = self.shape.GetBoundingBox(True)
            pt1 = box.Corner(True, True, True)
            pt2 = box.Corner(False, False, False)
            height = pt2.Y-pt1.Y
            width = pt2.X-pt1.X
            if(height >= maxH or width >= maxW):
                return False
            else:
                #Diviation fulfill?
                if(self.Cdiv <= iDiv and self.Tdiv <= iDiv):
                    self.stable = True
                    Cell.countStable += 1
                    return True
                if(width*0.5 < minW or height*0.5 < minH):
                    self.stable = True
                    Cell.countStable += 1
                    return True
                return False
    
    def getForce(self, iSiMa, iMa):
        # if reach iDiviation?
        # if reach size limitation?
        #only one Type of force
        if(self.TinLength == 0):
            newForce = self.Cforce
        elif(self.CinLength == 0):
            newForce = self.Tforce
        else:
            sum = self.CinLength + self.TinLength
            newForce = self.Cforce*self.CinLength/sum + self.Tforce*self.TinLength/sum
        if(iSiMa):
            return newForce
        else:
            if(self.Cforce.Length >= self.Tforce.Length):
                if(self.Tforce.Length >= iMa):
                    self.material = False #"C"
            else:
                if(self.Cforce.Length >= iMa):
                    self.material = False #"C"
        return newForce
    
    def getShape(self):
        if(self.shape.IsValid):
            count = 0
            i = self.shape.Edges.GetEnumerator()
            curves = []
            while(count < self.shape.Edges.Count):
                curves.append(next(i))
                count += 1
            curve = rg.Curve.JoinCurves(curves)
            return curve
        else:
            print("Warning: shape brep not valid!")
            return

def getCenterX(brep):
    return brep.shape.GetBoundingBox(True).Center.X
def getCenterY(brep):
    return brep.shape.GetBoundingBox(True).Center.Y
def getI(cell):
    return cell.i
def getLayer(cell):
    return cell.layer

List = []
vList = []
mList = []
OutList = []
lList = []
bList = []


#Iteration
for l in range(iLayers):
    #first cell
    cell0 = Cell(0, iBoundary, False, l)
    List.append(cell0)
    cell0.calculateDiv(iCVectors, iCLocations, True)
    cell0.calculateDiv(iTVectors, iTLocations, False)
    newList = []
    newList.append(cell0)
    #starting each iteration
    for i in range(iteration):
        for j in range(len(newList)):
            if(newList[j].i == (i-1)):
                if(newList[j].isStable(maxHeight, maxWidth, minHeight, minWidth, iDiviation)):
                    newList[j].i += 1
                else:
                    newCells = newList[j].subdivide()
                    newCells[0].calculateDiv(iCVectors, iCLocations, True)
                    newCells[0].calculateDiv(iTVectors, iTLocations, False)
                    newCells[1].calculateDiv(iCVectors, iCLocations, True)
                    newCells[1].calculateDiv(iTVectors, iTLocations, False)
                    List.append(newCells[0])
                    List.append(newCells[1])
                    newList.append(newCells[0])
                    newList.append(newCells[1])
        newList.sort(key=getCenterY)
        newList.sort(key=getCenterX)
        if((i == iteration-1 or Cell.countCells == Cell.countStable) and l == iLayers - 1):
            #sorting pieces from left to right, from up to down
            List.sort(key=getCenterY)
            List.sort(key=getCenterX)
            List.sort(key=getI)
            List.sort(key=getLayer)
            for j in range(len(List)):
                if(List[j].i == i):
                    OutCurves = List[j].getShape()
                    for c in OutCurves:
                        OutList.append(c)
                    vList.append(List[j].getForce(iSingleMa, iMaDif))
                    List[j].calculateDiv(iCVectors, iCLocations, True)
                    List[j].calculateDiv(iTVectors, iTLocations, False)
                    mList.append(List[j].material)
                    lList.append(List[j].layer)
                    bList.append(List[j].shape)
            break


#out
oCurves = OutList
oBreps = bList
oVectors = vList
oMLabels = mList
oLayers = lList
oSavedPos = []
for pt in Cell.divPositions:
    oSavedPos.append(pt.Location)
# ---------- end cellularmodel_c_3 ----------
area_2 = Area(Geometry=cellularmodel_c_3.oBreps)  # -> Area, Centroid
dispatch = Dispatch(List=cellularmodel_c_3.oBreps, DispatchPattern=cellularmodel_c_3.oLayers)  # -> ListA, ListB
srf = Surface(dispatch.ListA)
points = PointList(Points=area_2.Centroid, Size=20)
srf_2 = Surface(dispatch.ListB)

# ----
item = ListItem(List=cellularmodel_c_3.oBreps, Index=Slider(25, range=1..50), Wrap=True)

# ----
# Scarf Joints
thickness = Slider(9, range=3..100)
Z = UnitZ(Factor=thickness)
extr = Extrude(Base=cellularmodel_c_3.oBreps, Direction=Z)
extr_2 = Extrude(Base=brep, Direction=Z)
cap = CapHoles(Brep=extr_2)
findcofaces = GhPythonScript(iBoundary=cap, iBreps=extr, iAngle=Slider(30, range=1..180), iThickness=Z, iLayers=cellularmodel_c_3.oLayers)  # -> oUpCurves, oBuCurves, oBreps; inputs iBoundary: Brep, iBreps: list of Brep, iLayers: list of Int32
# ---------- findcofaces: Python ----------
__author__ = "zhanshi"
__version__ = "2023.06.01"
        

import rhinoscriptsyntax as rs
import Rhino.Geometry as rg
import math
import copy

class Plates:
                
    countPlates = 0
            
    def __init__(self, brep, layer):
        self.shape = brep
        self.id = Plates.countPlates
        Plates.countPlates += 1
        self.neibours = []
        self.coFaces = []
        self.isShifted = [] ##shifted
        self.layer = layer
        
oBreps = []
myList = []

#find neighbours
for b in iBreps:
    myList.append(Plates(b, iLayers[iBreps.index(b)]))
    for v in myList[-1].shape.Vertices:
        myList[-1].isShifted.append(False)
if(Plates.countPlates>1):
    for i in xrange(Plates.countPlates):
        aFaces = myList[i].shape.Faces
        a = aFaces.GetEnumerator()
        count = 0
        while(count < aFaces.Count):
            aFace = next(a)
            aBox = aFace.ToBrep()
            if(iBoundary.IsPointInside(aBox.GetBoundingBox(True).Center, 0.1, True)):
                for j in xrange(Plates.countPlates):
                    if(j != i and myList[i].layer == myList[j].layer):
                        bFaces = myList[j].shape.Faces
                        b = bFaces.GetEnumerator()
                        num = 0
                        while(num < bFaces.Count):
                            bFace = next(b)
                            bBox = bFace.ToBrep()
                            if(len(myList[i].neibours) == 0 or myList[i].neibours.count(myList[j].id) == 0):
                                if(iBoundary.IsPointInside(bBox.GetBoundingBox(True).Center, 0.1, True)):
                                    bool = rg.Brep.CreateBooleanIntersection(aBox, bBox, 0.1)
                                    if(bool != None and len(bool) > 0 and bool[0].IsSurface):
                                        v1 = aFace.NormalAt(1, 1)
                                        v2 = bFace.NormalAt(1, 1)
                                        degree = math.degrees(rg.Vector3d.VectorAngle(v1, v2))
                                        if(degree > 179):
                                            myList[i].neibours.append(myList[j].id)
                                            myList[i].coFaces.append(aFace.FaceIndex)
                            num += 1
            count += 1

for b in myList:
    print(b.neibours, b.id, b.layer, b.coFaces)

def checkPosition(boudary, pt):
    faces = boudary.Faces
    count = 0
    f = faces.GetEnumerator()
    on = 0
    ang = 0
    while(count < faces.Count):
        face = next(f)
        dis = face.PointAt(face.ClosestPoint(pt)[1],face.ClosestPoint(pt)[2]).DistanceTo(pt)
        if(dis < 1):
            on += 1
            dir = face.NormalAt(0.1, 0.1)
            nAngle = math.degrees(rg.Vector3d.VectorAngle(rg.Vector3d(1, 0, 0), dir))
            zAngle = math.degrees(rg.Vector3d.VectorAngle(rg.Vector3d(0, 0, 1), dir))
            if(abs(zAngle - 90) < 1):
                ang = 90 - nAngle
        count += 1
    l = iThickness / math.tan(math.radians(iAngle))
    if(on == 1):
        pt += rg.Vector3d(l, l, .0)
    elif(on == 2):
        #shifting on the surface 
        pt += rg.Vector3d(l*math.cos(math.radians(ang)), -l*math.sin(math.radians(ang)), .0)
    return pt

#new Paths
newList = []
oUpCurves = []
oBuCurves = []

for b in myList:
    vList = b.shape.Vertices
    uPtList = rg.PointCloud()
    bPtList = rg.PointCloud()
    tempList = []
    for V in vList:
        pt = V.Location
        if(pt.Z >= (iThickness - 1)):
            pt = checkPosition(iBoundary, pt)
            #define new vertices
            V.Location = pt
            uPtList.Add(pt)
            tempList.append(pt)
        else:
            bPtList.Add(pt)
            tempList.append(pt)
    def getX(s):
        return s.X
    def getY(s):
        return s.Y
    tempList.sort(key=getY)
    tempList.sort(key=getX)
    #start sorting
    p = tempList[0]
    up = uPtList.PointAt(uPtList.ClosestPoint(p))
    uList = [up]
    bList = [p]
    count = 0
    while(bPtList.ClosestPoint(p) != -1  and count < 20):
        if(bList[-1].DistanceTo(p) < 1):
            bPtList.RemoveAt(bPtList.ClosestPoint(p))
            if(bPtList.ClosestPoint(p) != -1):
                p = bPtList.PointAt(bPtList.ClosestPoint(p))
        else:
            bList.append(p)
        count += 1
    count = 0
    while(uPtList.ClosestPoint(up) != -1  and count < 20):
        if(uList[-1].DistanceTo(up) < 1):
            uPtList.RemoveAt(uPtList.ClosestPoint(up))
            if(uPtList.ClosestPoint(up) != -1):
                up = uPtList.PointAt(uPtList.ClosestPoint(up))
        else:
            uList.append(up)
        count += 1
    uList.append(uList[0])
    bList.append(bList[0])
    if(uList[1].DistanceTo(bList[1]) > 50):
        bList.reverse()
    oUpCurves.append(uList)
    oBuCurves.append(bList)

List1 = []
List2 = []
for l in oUpCurves:
    List1.append(rg.PolylineCurve(l))
for l in oBuCurves:
    List2.append(rg.PolylineCurve(l))
oUpCurves = List1
oBuCurves = List2
oBreps = []
for i in range(len(List1)):
    surfaces = rg.NurbsSurface.CreateRuledSurface(List1[i], List2[i])
    oBreps.append(surfaces.ToBrep().CapPlanarHoles(0.1))
# ---------- end findcofaces ----------
crv_17 = Curve(findcofaces.oUpCurves)
crv_18 = Curve(findcofaces.oBuCurves)
brep_2 = Brep(findcofaces.oBreps)

# ---- group: Cellular Model (continued)
extr_3 = Extrude(Base=item, Direction=Z)
debrep = DeconstructBrep(Brep=extr_3)  # -> Faces, Edges, Vertices
area_3 = Area(Geometry=debrep.Faces)  # -> Area, Centroid
points_2 = PointList(Points=area_3.Centroid, Size=20)

# ---- group: TimbePlates
Z_2 = UnitZ(Factor=thickness)  # disabled
extr_4 = Extrude(Base=rec_2, Direction=Z_2)  # disabled
cap_2 = CapHoles(Brep=extr_4)  # disabled
dim = Dimensions(Surface=rec)  # -> UDimension, VDimension; disabled
build = PlateModelBuilder(Breps=cap_2)  # -> Model, Breps, Sequence, Log; disabled
neighbours = NeighboursIDs(Model=build.Model)  # -> Ids, Pairs, Neighbours; disabled
getmodules = GhPythonScript(iRec=rec_2, iLength=dim.VDimension, iID=neighbours.Ids)  # -> out, count; inputs iRec: list of Rectangle3d, iID: tree of Int32; disabled
# ---------- getmodules: Python ----------
__author__ = "zhanshi"
__version__ = "2023.05.23"

import rhinoscriptsyntax as rs
import Rhino.Geometry as rg
#import ghpythonlib.treehelpers as th

x = []

for i in range(iID.BranchCount):
    x.append(iID.Branch(i))

groups = []

for i in range(len(x)):
    if(abs(iRec[i].Height - iLength) <= 0.01):
        groups.append([i])
    else:
        pt1 = iRec[i].Center
        for j in range(len(x[i])):
            pt2 = iRec[x[i][j]].Center
            if(pt2.Y > pt1.Y and abs(iRec[x[i][j]].Height - iLength) >= 0.01):
                groups.append([i, x[i][j]])
                break

newGroups = []
for i in range(len(groups)):
    if(len(groups[i]) == 1):
        newGroups.append(groups[i])
    else:
        if(i < len(groups)-1):
            if(groups[i][-1] == groups[i+1][-1]):
                newGroups.append([groups[i][0],groups[i+1][0],groups[i][1]])
            else:
                if(len(newGroups) == 0 or newGroups[-1][-1] != groups[i][-1]):
                    newGroups.append(groups[i])
        else:
            if(newGroups[-1][-1] != groups[i][1]):
                newGroups.append(groups[i])

print(newGroups)

count = len(newGroups)
# ---------- end getmodules ----------
sequence = DisplaySequence(breps=build.Breps)  # disabled

# ----
# Finger Joint
number_slider_6 = Slider(10, range=1..100)
findcofaces_2 = GhPythonScript(
    iBoundary=cap,
    iBreps=extr,
    iLayers=cellularmodel_c_3.oLayers,
    iThickness=Z,
    iJWidth=number_slider_6,
    iJLength=Slider(15, range=1..100))  # -> oBreps, oPosJoints, oNegJoints, oPolylines, a; inputs iBoundary: Brep, iBreps: list of Brep, iLayers: list, iJWidth: Int32, iJLength: Int32
# ---------- findcofaces_2: Python ----------
__author__ = "zhanshi"
__version__ = "2023.06.01"

import rhinoscriptsyntax as rs
import Rhino.Geometry as rg
import math
import copy

class Plates:
                
    countPlates = 0
            
    def __init__(self, brep, layer):
        self.shape = brep
        self.id = Plates.countPlates
        Plates.countPlates += 1
        self.neibours = []
        self.coFaces = []
        self.isShifted = [] ##shifted
        self.layer = layer
        self.PosJoints = []
        self.NegJoints = []
        self.jCountCoFaces = []

myList = []

#find neighbours
for b in iBreps:
    myList.append(Plates(b, iLayers[iBreps.index(b)]))
    for v in myList[-1].shape.Vertices:
        myList[-1].isShifted.append(False)
if(Plates.countPlates>1):
    for i in range(Plates.countPlates):
        aFaces = myList[i].shape.Faces
        a = aFaces.GetEnumerator()
        count = 0
        while(count < aFaces.Count):
            aFace = next(a)
            aBox = aFace.ToBrep()
            if(iBoundary.IsPointInside(aBox.GetBoundingBox(True).Center, 0.1, True)):
                for j in xrange(Plates.countPlates):
                    if(j != i and myList[i].layer == myList[j].layer):
                        bFaces = myList[j].shape.Faces
                        b = bFaces.GetEnumerator()
                        num = 0
                        while(num < bFaces.Count):
                            bFace = next(b)
                            bBox = bFace.ToBrep()
                            if(len(myList[i].neibours) == 0 or myList[i].neibours.count(myList[j].id) <= 1):
                                if(iBoundary.IsPointInside(bBox.GetBoundingBox(True).Center, 0.1, True)):
                                    bool = rg.Brep.CreateBooleanIntersection(aBox, bBox, 0.000001)
                                    if(bool != None and len(bool) > 0 and bool[0].IsSurface):
                                        v1 = aFace.NormalAt(1, 1)
                                        v2 = bFace.NormalAt(1, 1)
                                        degree = math.degrees(rg.Vector3d.VectorAngle(v1, v2))
                                        if(degree > 179):
                                            myList[i].neibours.append(myList[j].id)
                                            myList[i].coFaces.append(count)
                                            myList[i].jCountCoFaces.append(0)
                            num += 1
            count += 1

#for b in myList:
#    print(b.neibours, b.id, b.layer, b.coFaces, b.jCountCoFaces)

def checkIfJointFull(plate, faceIndex, width):
    if(plate.jCountCoFaces[plate.coFaces.index(faceIndex)]==0):
        return False
    face = plate.shape.Faces[faceIndex]
    edges = face.AdjacentEdges()
    length = 0
    for e in edges:
        edge = plate.shape.Edges[e]
        if(getMidPoint(edge).Z > (iThickness -1)):
            length = edge.PointAtEnd.DistanceTo(edge.PointAtStart)
            break
    return ((plate.jCountCoFaces[plate.coFaces.index(faceIndex)] + 6) * width >= length)

def getMidPoint(brepEdge):
    return (brepEdge.PointAtStart + brepEdge.PointAtEnd) / 2

a = []

#calculate the joints
for b in myList:
    for ne in range(len(b.neibours)):
        n = b.neibours[ne]
        faceIndex = b.coFaces[ne]
        face = b.shape.Faces[faceIndex]
        nei = myList[n]
        neiFaceIndex = nei.coFaces[nei.neibours.index(b.id)]
        neiFace = nei.shape.Faces[neiFaceIndex]
        edgesIndices = face.AdjacentEdges()
        neiEdgesIndices = neiFace.AdjacentEdges()
        num = 0
        upEdge = None
        buEdge = None
        upNeiEdge = None
        buNeiEdge = None
        for e in edgesIndices:
            edge = b.shape.Edges[e]
            if(getMidPoint(edge).Z > iThickness - 1):
                upEdge = edge
            elif(getMidPoint(edge).Z < 1):
                buEdge = edge
        for e in neiEdgesIndices:
            edge = nei.shape.Edges[e]
            if(getMidPoint(edge).Z > iThickness - 1):
                upNeiEdge = edge
            elif(getMidPoint(edge).Z < 1):
                buNeiEdge = edge
        length = upEdge.PointAtStart.DistanceTo(upEdge.PointAtEnd)
        neiLength = upNeiEdge.PointAtStart.DistanceTo(upNeiEdge.PointAtEnd)
        conti = True
        if(length <= neiLength):
            conti = not checkIfJointFull(b, faceIndex, iJWidth)
        else:
            conti = not  checkIfJointFull(nei, neiFaceIndex, iJWidth)
        if(conti):
            if(neiLength < length):
                num = int(neiLength // iJWidth)
            else:
                num = int(length // iJWidth)
            num -= 4
            if(num < 1):
                num = 1
            if(neiLength < length):
                extra = (neiLength - num * iJWidth) / 2
            else:
                extra = (length - num * iJWidth) / 2
            for i in range(num):
                #see edge direction
                if(neiLength < length):
                    angle = math.degrees(rg.Vector3d.VectorAngle(upNeiEdge.TangentAtStart, rg.Vector3d(1.0, .0, .0)))
                    pt1 = upNeiEdge.PointAtLength(extra + i * iJWidth)
                    pt2 = buNeiEdge.PointAtLength(extra + (i + 1) * iJWidth)
                else:
                    angle = math.degrees(rg.Vector3d.VectorAngle(upEdge.TangentAtStart, rg.Vector3d(1.0, .0, .0)))
                    pt1 = upEdge.PointAtLength(extra + i * iJWidth)
                    pt2 = buEdge.PointAtLength(extra + (i + 1) * iJWidth)
                if(angle > 45 and angle < 135):
                    if(i%2 == 0):
                        pt2 -= rg.Vector3d(iJLength, .0, .0)
                    else:
                        pt2 += rg.Vector3d(iJLength, .0, .0)
                    box = rg.BoundingBox(pt1, pt2).ToBrep()
                    if(i%2 == 0):
                        b.NegJoints.append(box)
                        nei.PosJoints.append(box)
                    else:
                        b.PosJoints.append(box)
                        nei.NegJoints.append(box)
                    a.append(box)
                else:
                    if(i%2 == 0):
                        pt2 -= rg.Vector3d(.0, iJLength, .0)
                    else:
                        pt2 += rg.Vector3d(.0, iJLength, .0)
                    box = rg.BoundingBox(pt1, pt2).ToBrep()
                    if(i%2 == 0):
                        b.NegJoints.append(box)
                        nei.PosJoints.append(box)
                    else:
                        b.PosJoints.append(box)
                        nei.NegJoints.append(box)
                    a.append(box)
                b.jCountCoFaces[b.neibours.index(n)] += 1
                nei.jCountCoFaces[nei.neibours.index(b.id)] += 1

bList = []
pJList = []
nJList = []
cList = []

#check again if no joints on faces
for br in myList:
    for co in range(len(br.jCountCoFaces)):
        if(br.jCountCoFaces[co] == 0):
            neibo = myList[br.neibours[co]]
            for ne in range(len(neibo.jCountCoFaces)):
                if(neibo.jCountCoFaces[ne] == 0 and neibo.neibours[ne] == br.id):
                    faceIndex = br.coFaces[co]
                    face = br.shape.Faces[faceIndex]
                    neiFaceIndex = neibo.coFaces[ne]
                    neiFace = neibo.shape.Faces[neiFaceIndex]
                    edgesIndices = face.AdjacentEdges()
                    neiEdgesIndices = neiFace.AdjacentEdges()
                    num = 0
                    upEdge = None
                    buEdge = None
                    upNeiEdge = None
                    buNeiEdge = None
                    for e in edgesIndices:
                        edge = br.shape.Edges[e]
                        if(getMidPoint(edge).Z > iThickness - 1):
                            upEdge = edge
                        elif(getMidPoint(edge).Z < 1):
                            buEdge = edge
                    for e in neiEdgesIndices:
                        edge = neibo.shape.Edges[e]
                        if(getMidPoint(edge).Z > iThickness - 1):
                            upNeiEdge = edge
                        elif(getMidPoint(edge).Z < 1):
                            buNeiEdge = edge
                    length = upEdge.PointAtStart.DistanceTo(upEdge.PointAtEnd)
                    neiLength = upNeiEdge.PointAtStart.DistanceTo(upNeiEdge.PointAtEnd)
                    if(neiLength < length):
                        num = int(neiLength // iJWidth)
                    else:
                        num = int(length // iJWidth)
                    num -= 4
                    if(num < 1):
                        num = 1
                    extra = (length - num * iJWidth) / 2
                    for i in range(num):
                       #see edge direction
                        angle = math.degrees(rg.Vector3d.VectorAngle(upEdge.TangentAtStart, rg.Vector3d(1.0, .0, .0)))
                        pt1 = upEdge.PointAtLength(extra + i * iJWidth)
                        pt2 = buEdge.PointAtLength(extra + (i + 1) * iJWidth)
                        if(angle > 45 and angle < 135):
                            if(i%2 == 0):
                                pt2 -= rg.Vector3d(iJLength, .0, .0)
                            else:
                                pt2 += rg.Vector3d(iJLength, .0, .0)
                            box = rg.BoundingBox(pt1, pt2).ToBrep()
                            if(i%2 == 0):
                                br.NegJoints.append(box)
                                neibo.PosJoints.append(box)
                            else:
                                br.PosJoints.append(box)
                                neibo.NegJoints.append(box)
                                a.append(box)
                        else:
                            if(i%2 == 0):
                                pt2 -= rg.Vector3d(.0, iJLength, .0)
                            else:
                                pt2 += rg.Vector3d(.0, iJLength, .0)
                            box = rg.BoundingBox(pt1, pt2).ToBrep()
                            if(i%2 == 0):
                                br.NegJoints.append(box)
                                neibo.PosJoints.append(box)
                            else:
                                br.PosJoints.append(box)
                                neibo.NegJoints.append(box)
                                a.append(box)
                        br.jCountCoFaces[co] += 1
                        neibo.jCountCoFaces[ne] += 1

def checkIfCorners(brep, point):
    count = 0
    vList = brep.Vertices
    v = vList.GetEnumerator()
    while(count < vList.Count):
        dis = next(v).Location.Distanceto(point)
        if(dis < 1):
            return True
        count += 1
    return False

#output: Union/Split, Breps, Polyline
for br in myList:
    #Union and Split in Brep
    pos = br.PosJoints
    neg = br.NegJoints
    pJList.append(pos)
    nJList.append(neg)
    bList.append(br.shape)
    #Vertices for new Polyline
    newList = []
    sortList = []
    ptCloud = rg.PointCloud()
    for v in br.shape.Vertices:
        if(v.Location.Z < 1):
            ptCloud.Add(v.Location)
            sortList.append(v.Location)
    for j in br.PosJoints:
        for v in j.Vertices:
            nearPt = ptCloud.PointAt(ptCloud.ClosestPoint(v.Location))
            dis = nearPt.DistanceTo(v.Location)
            if(dis > 1 and v.Location.Z < 1):
                ptCloud.Add(v.Location)
                sortList.append(v.Location)
    for j in br.NegJoints:
        for v in j.Vertices:
            nearPt = ptCloud.PointAt(ptCloud.ClosestPoint(v.Location))
            dis = nearPt.DistanceTo(v.Location)
            if(dis > 1 and v.Location.Z < 1):
                ptCloud.Add(v.Location)
                sortList.append(v.Location)
    def getX(s):
        return s.X
    def getY(s):
        return s.Y
    sortList.sort(key=getY)
    sortList.sort(key=getX)
    newList.append(sortList[0])
    p = newList[-1]
    ptCloud.RemoveAt(ptCloud.ClosestPoint(p))
    newPt = ptCloud.PointAt(ptCloud.ClosestPoint(p))
    newList.append(newPt)
    while(ptCloud.Count > 0):
        p = newList[-1]
        newIn = ptCloud.ClosestPoint(p)
        newPt = ptCloud.PointAt(newIn)
        dis = newPt.DistanceTo(p)
        if(dis < 1):
            ptCloud.RemoveAt(newIn)
        else:
            line1 = rg.Line(newList[-2], p)
            line2 = rg.Line(p, newPt)
            angle = math.degrees(rg.Vector3d.VectorAngle(line1.Direction, line2.Direction))
            if(angle < 5):
                ptCloud.RemoveAt(newIn)
                nextIn = ptCloud.ClosestPoint(p)
                if(nextIn >= 0):
                    nextPt = ptCloud.PointAt(nextIn)
                    newList.append(nextPt)
                    ptCloud.Add(newPt)
            else:
                newList.append(newPt)
    newList.append(newList[0])
    cList.append(rg.PolylineCurve(newList))


oBreps = bList
oPosJoints = []
oNegJoints = []
oPolylines = cList
for pJ in pJList:
    for j in pJ:
        oPosJoints.append(j)
for nJ in nJList:
    for j in nJ:
        oNegJoints.append(j)
# ---------- end findcofaces_2 ----------
brep_3 = Brep(findcofaces_2.oBreps)
brep_4 = Brep(findcofaces_2.oPosJoints)
brep_5 = Brep(findcofaces_2.oNegJoints)
brep_6 = Brep(findcofaces_2.a)

# ---- group: FingerJoints
# Finger Joints in Manis
build_2 = PlateModelBuilder(Run=True, Breps=cap_2, Sequence=getmodules.out)  # -> Model, Breps, Sequence, Log; disabled
number_slider_7 = Slider(10, range=0..100)  # disabled
number_slider_8 = Slider(15, range=0..100)  # disabled
number_slider_9 = Slider(3, range=0..100)  # disabled
finger = AddFingerJoint(
    Model=build_2.Model,
    Finger_number_1=number_slider_9,
    Finger_length_1=number_slider_7,
    Finger_width_1=number_slider_8,
    Finger_number_2=number_slider_9,
    Finger_length_2=number_slider_7,
    Finger_width_2=number_slider_8,
    Finger_spacing=number_slider,
    Finger_shift=number_slider_2,
    Mirror=True)  # -> Model, Joints_positives, Joints_negatives, Joints_keys; disabled

# ----
crv_19 = Curve(findcofaces_2.oPolylines)

item_2 = ListItem(List=crv_19, Index=Slider(1, range=1..100), Wrap=True)
explode = Explode(Curve=item_2, Recursive=True)  # -> Segments, Vertices
midpt_4 = CurveMiddle(Curve=explode.Segments)
points_3 = PointList(Points=midpt_4, Size=5)

# ---- group: Assembly
# TBC:
# Numbering differ from assembly sequence
# Assembly Sequence
toggle = BooleanToggle(True)  # disabled
number_slider_10 = Slider(21, range=0..21)  # disabled
merge = MergeJointsWithPlates(Run=toggle, Model=finger.Model, Bool_tol=1, Merge_tol=1)  # -> Model, Breps; disabled
sequence_2 = DisplaySequence(breps=merge.Breps)  # disabled
deci = SplitDecimals(Num=counter_2)  # -> Int, Deci; disabled
modules = GetModules(Model=merge.Model, Module_id=deci.Int)  # -> Module, Sequence, Step, Breps; disabled
number_slider_11 = Slider(10, range=0..10)  # disabled
anim = AnimateSequence(Model=modules.Module, Step=deci.Deci, Retreat=number_slider_11)  # -> Breps, Status; disabled

# ---- group: Nesting
# Nesting in OpenNest
Y = UnitY(Factor=1)  # disabled
cluster = Cluster(A=vec, B_2=Y, B=merge.Breps)  # -> A_2, brep_2, pt_2; disabled
rot3d = Rotate3D(Geometry=cluster.brep_2, Angle=cluster.A_2, Center=cluster.pt_2, Axis=Vector(0, 0, 1))  # -> Geometry, Transform; disabled
project = Project(Polyline=rot3d.Geometry)  # -> Polyline, Plane; disabled
pcen_3 = PolygonCenter(Polyline=project.Polyline)  # -> CenterV, CenterE, CenterA; disabled
pack = PackObjects(Geo=rot3d.Geometry, Plane=project.Plane, X=1, Y=1, Tolerabce=0)  # -> Geo, Transformation; disabled
points_4 = PointList(Points=pcen_3.CenterV, Size=100)  # disabled
pcen_4 = PolygonCenter(Polyline=pack.Geo)  # -> CenterV, CenterE, CenterA; disabled
points_5 = PointList(Points=pcen_4.CenterV, Size=50)  # disabled
number_slider_12 = Slider(20, range=0..100)  # disabled
number_slider_13 = Slider(10, range=0..20)  # disabled
number_slider_14 = Slider(0.2, range=0..19)  # disabled
number_slider_15 = Slider(8, range=0..20)  # disabled
number_slider_16 = Slider(5, range=0..20)  # disabled
opennest = OpenNest(
    Sheets=crv_12,
    Geo=pack.Geo,
    Spacing=number_slider_12,
    Placement=number_slider_13,
    Tolerance=number_slider_14,
    Rotations=1,
    Iterations=number_slider_15,
    Seed=number_slider_16,
    Reset=True,
    Run=False)  # -> Sheets, Geo, ID, Transform, IDS; disabled
pcen_5 = PolygonCenter(Polyline=opennest.Geo)  # -> CenterV, CenterE, CenterA; disabled
brec = BoundingRectangle(Geometry=opennest.Geo, Plane=PlaneXY(0, 0, 0), Axis=0, Slide=0, Union=True)  # -> Bounding, DimensionX, DimensionY; disabled
points_6 = PointList(Points=pcen_5.CenterV, Size=100)  # disabled
crv_20 = Curve(opennest.Sheets)  # disabled

# ---- group: TimbePlates
brep_7 = Brep(opennest.Geo)  # disabled
Z_3 = UnitZ(Factor=thickness)  # disabled
extr_5 = Extrude(Base=brep_7, Direction=Z_3)  # disabled
cap_3 = CapHoles(Brep=extr_5)  # disabled
build_3 = PlateModelBuilder(Breps=cap_3)  # -> Model, Breps, Sequence, Log; disabled
sequence_3 = DisplaySequence(breps=build_3.Breps)  # disabled

# ---- group: CNC-cutpath
# Cutting Path for CNC
number_slider_17 = Slider(0.2, range=0.01..0.3)  # disabled
number_slider_18 = Slider(0.1, range=0.1..0.2)  # disabled
toggle_2 = BooleanToggle(True)  # disabled
toggle_3 = BooleanToggle(True)  # disabled
toolpath = ToolpathGenerator(
    Model=build_3.Model,
    Contour_tool_radius=number_slider_17,
    Holes_tool_radius=number_slider_18,
    Notch=toggle_2,
    Cylinder=toggle_2,
    Tbone=toggle_3)  # -> Model, Top_milling_contour, Bottom_milling_contour, Top_milling_holes, Bottom_milling_holes; disabled
number_slider_19 = Slider(0.1, range=0..0.1)  # disabled
number_slider_20 = Slider(0.01, range=0..0.01)  # disabled
toggle_4 = BooleanToggle(True)  # disabled
merge_2 = MergeJointsWithPlates(Run=toggle_4, Model=toolpath.Model, Bool_tol=number_slider_20, Merge_tol=number_slider_19)  # -> Model, Breps; disabled
sequence_4 = DisplaySequence(breps=merge_2.Breps)  # disabled

# ---- group: CNC-cutpath / text
brep_8 = Brep(build_3.Breps)  # disabled
area_4 = Area(Geometry=brep_8)  # -> Area, Centroid; disabled
index = ItemIndex(List=area_4.Centroid, Item=area_4.Centroid)  # disabled
text_2 = Text(Location=area_4.Centroid, Text=index, Size=100)  # disabled

# ---- group: Result recording
# Results Evaluation
area_5 = Area(Geometry=brec.Bounding)  # -> Area, Centroid; disabled
area_6 = Area(Geometry=opennest.Sheets)  # -> Area, Centroid; disabled
lng = ListLength(List=area_6.Area)  # disabled
item_3 = ListItem(List=area_6.Area, Index=0, Wrap=True)  # disabled
multiplication = Multiplication(A=item_3, B=lng)  # disabled

# ----
x_minus_one = XMinusOne(NumberX=lng)  # disabled
multiplication_2 = Multiplication(A=area.Area, B=x_minus_one)  # disabled

# ---- group: Result recording (continued)
subtraction = Subtraction(A=area_5.Area, B=multiplication_2)  # disabled
division = Division(A=subtraction, B=multiplication)  # disabled
rec_3 = DataRecorder(division, DataLimit=-10, RecordData=True)  # disabled
panel_6 = Panel(rec_3)  # disabled

# ==== cluster DisplaySequence: Display a colorful assembly sequence.
breps = ClusterInput()  # Plate as Brep

# ---- group: Brep
dom = ConstructDomain(DomainStart=Slider(0, range=0..1), DomainEnd=Slider(0.3, range=0..1))
lng = ListLength(List=breps)
range = Range(Domain=dom, Steps=lng)
hsl = ColourHSL(Alpha=Slider(0.26, range=0..1), Hue=range, Saturation=Slider(1, range=0..1), Luminance=Slider(0.6, range=0..1))
preview = CustomPreview(Geometry=breps, Material=hsl)

# ---- group: Text
area = Area(Geometry=breps)  # -> Area, Centroid
index = ItemIndex(List=breps, Item=breps)
pl = ConstructPlane(Origin=area.Centroid, XAxis=Vector(1, 0, 0), YAxis=Vector(0, 0, 1))
sqrt = SquareRoot(Value=area.Area)
division = Division(A=sqrt, B=10)
tag = TextTag3D(Location=pl, Text=index, Size=division, Colour=ColourSwatch(SwatchColor=RGB(0, 0, 0)), Justification=5)

# ==== cluster Cluster
B = ClusterInput()
debrep = DeconstructBrep(Brep=B)  # -> Faces, Edges, Vertices
area = Area(Geometry=debrep.Faces)  # -> Area, Centroid
pdecon = Deconstruct(Point=area.Centroid)  # -> XComponent, YComponent, ZComponent
sort = SortList(Keys=pdecon.ZComponent, ValuesA=debrep.Faces)  # -> Keys, ValuesA
item = ListItem(List=sort.ValuesA, Index=0, Wrap=True)  # -> flatten(Item)
brep = Brep(item)
pcen = PolygonCenter(Polyline=brep)  # -> CenterV, CenterE, CenterA
brep_2 = ClusterOutput(brep)
pt = Point(pcen.CenterA)
pl = ConstructPlane(Origin=pt, XAxis=Vector(1, 0, 0), YAxis=Vector(0, 1, 0))
A = ClusterInput()
B_2 = ClusterInput()
pt_2 = ClusterOutput(pt)
angle = Angle(VectorA=A, VectorB=B_2, Plane=pl)  # -> Angle, Reflex
A_2 = ClusterOutput(angle.Angle)
