# Grasshopper definition seg_07.06.gh (Grasshopper 1.0.7)
# plug-ins: OpenNest, Robot trajectory, Pufferfish, Human

# ---- group: Input Tension
# Input Forces
# Input from rhino: Edit-Select object-By color
crv = Curve([<curve referenced from the Rhino model> x4034])

# ---- group: Input Compression
crv_2 = Curve([<curve referenced from the Rhino model> x5000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])

# ---- group: Input Geometry
# Input Geometry
rec = Rectangle({Plane=PlaneXY(3000.15, 93.6, 0), Size=Domain2(u=-3000.15..3000.15, v=-199.8..199.8)})

# ---- group: Reading Numbers / Tension values
# Input Force Values
id = Guid([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])

# ---- group: Reading Numbers / Compression values
# Input from rhino: Edit-Select object-Text
id_2 = Guid([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])

# ---- group: Reading Numbers
c_script = CSharpScript(id=id)  # -> out, text, plane; inputs id: Guid; disabled
# ---------- c_script: C# usings ----------
using System.IO;
using System.Linq;
using System.Data;
using System.Drawing;
using System.Reflection;
using System.Windows.Forms;
using System.Xml;
using System.Xml.Linq;
using System.Runtime.InteropServices;

using Rhino.DocObjects;
using Rhino.Collections;
using GH_IO;
using GH_IO.Serialization;
# ---------- c_script: C# ----------
    RhinoObject ro = RhinoDocument.Objects.Find(id);

    if(ro.ObjectType != ObjectType.Annotation) return;

    TextObject txt = ro as TextObject;

    text = txt.TextGeometry.Text;
    plane = txt.TextGeometry.Plane;
# ---------- end c_script ----------
c_script_2 = CSharpScript(id=id_2)  # -> out, text, plane; inputs id: Guid; disabled; same code as c_script
python = GhPythonScript(iValues=c_script.text)  # -> out, oMin; inputs iValues: list
# ---------- python: Python ----------
__author__ = "zhanshi"
__version__ = "2023.04.24"

import rhinoscriptsyntax as rs
import Rhino.Geometry as rg

min = iValues[0]
for i in iValues:
    if(i < min):
        min = i

oMin = min
# ---------- end python ----------
python_2 = GhPythonScript(iValues=c_script_2.text)  # -> out, oMax; inputs iValues: list
# ---------- python_2: Python ----------
__author__ = "zhanshi"
__version__ = "2023.04.24"

import rhinoscriptsyntax as rs
import Rhino.Geometry as rg

max = iValues[0]
for i in iValues:
    if(i > max):
        min = i

oMax = max
# ---------- end python_2 ----------

# ---- group: Voronoi
# Random Seeds
number_slider = Slider(83, range=0..500)  # disabled
panel = Panel("""Half geometry needed!
Symmetric""")  # disabled
pop2d = Populate2D(Region=rec, Count=number_slider, Seed=1)  # disabled
voronoi = Voronoi(Points=pop2d, Boundary=rec, BruteForceOverride=False)  # disabled
incurve = PointInCurve(Curve=graft(voronoi))  # -> simplify(Relationship), Point; disabled
pcen = PolygonCenter(Polyline=voronoi)  # -> CenterV, CenterE, CenterA; disabled
average = GhPythonScript(iPoints=incurve.Relationship)  # -> out, flatten(oAveForces); inputs iPoints: list of Int32, iForces: list of Curve, iVectors: list of Vector3d; disabled
# ---------- average: Python ----------
__author__ = "zhanshi"
__version__ = "2023.04.28"

import rhinoscriptsyntax as rs
import Rhino.Geometry as rg

tempVal = []
tempVec = []

for i in range(0, len(iPoints)):
    if(iPoints[i] == 2):
        tempVal.append(iForces[i])
        tempVec.append(iVectors[i])

if(len(tempVal)>1):
    sumLength = 0
    for i in range(0, len(tempVal)):
        sumLength += tempVal[i].GetLength()
    aveVec = tempVec[0] * tempVal[0].GetLength() / sumLength
    for i in range(1, len(tempVec)):
        factor = tempVal[i].GetLength() / sumLength
        aveVec +=  tempVec[i] * factor
    oAveForces = aveVec

if(len(tempVal)==1):
    oAveForces = tempVec[0]
# ---------- end average ----------
points = PointList(Points=pcen.CenterV, Size=50)  # disabled
vdis = VectorDisplay(Anchor=pcen.CenterV, Vector=average.oAveForces)  # disabled

# ---- group: Cellular Model / Other shapes
crv_3 = Curve(<curve referenced from the Rhino model>)
crv_4 = Curve(<curve referenced from the Rhino model>)

# ----
number_slider_2 = Slider(20, range=0..100)  # disabled
number_slider_3 = Slider(2, range=1..100)  # disabled

crv_5 = Curve(voronoi)  # disabled

# ---- group: Extra input tiles
einstein_tile = Curve([<curve referenced from the Rhino model> x31])  # disabled
crv_6 = Curve([<curve referenced from the Rhino model> x31])  # disabled

# ----
panel_2 = Panel("0.8")  # disabled

# ---- group: Diviation input
panel_3 = Panel("0.8")  # disabled

# ----
panel_4 = Panel("""Dimension
of Timber joints""")

# ---- group: Iteration
incr = Slider(1, range=0..10)
timer = Timer(Interval=10000, TimerInterval=10000, Target=counter)
reset = Button()
counter = PersistantPythonDataCounter(reset=reset, incr=incr, modVal="20")  # -> i; inputs reset: Boolean, modVal: Int32; disabled
# ---------- counter: Python ----------
__author__ = "adapted by Joseph Oster from code by Dharman.Gersch"
__version__ = "2020Mar4"

ghenv.Component.Name = 'Persistant Python Data Counter'
ghenv.Component.NickName = 'Counter'
ghenv.Component.Message = ''
ghenv.Component.Category = 'Demo'
ghenv.Component.SubCategory = ''

import rhinoscriptsyntax as rs
import scriptcontext as sc

# Setup unique name to avoid conflicts with other instances of this component
# or anything else that may use global dictionary 'sticky'
unique_counter_key = "counter_"+str(ghenv.Component.InstanceGuid)

if sc.sticky.has_key(unique_counter_key): #retieve value from last loop
    i = (sc.sticky[unique_counter_key])
else:
    i = 0

ghenv.Component.Message = str(i)
i += incr

if reset or ((modVal is not None) and (i > modVal)):
    i = 0

sc.sticky[unique_counter_key] = i #save value for next loop
# ---------- end counter ----------
panel_5 = Panel(counter)

# ----
crv_7 = Curve(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)
area = Area(Geometry=crv_7)  # -> Area, Centroid

# ---- group: Nesting / LVL Plates(CNC Masse/ LVL Masse)
crv_8 = Curve(<curve referenced from the Rhino model>)

# ----
incr_2 = Slider(0.1, range=0..10)  # disabled
timer_2 = Timer(Interval=-50, TimerInterval=50, Target=counter_2)  # disabled
panel_6 = Panel("21")  # disabled
reset_2 = Button()  # disabled
counter_2 = PersistantPythonDataCounter(reset=reset_2, incr=incr_2, modVal=panel_6)  # -> i; inputs reset: Boolean, modVal: Int32; disabled; same code as counter

# ----
# Data Sorting
panel_7 = Panel("0.1")
tol = GhPythonScript(iCompressions=crv_2, iTolerance=panel_7)  # -> out, oCurves; inputs iCompressions: list of Curve
# ---------- tol: Python ----------
__author__ = "zhanshi"
__version__ = "2023.04.24"

import rhinoscriptsyntax as rs
import Rhino.Geometry as rg

tolerance = iTolerance*0.5*100

#filter curves
useful_curves = []
for cur in iCompressions:
        length = cur.GetLength()
        if(length > tolerance):
            useful_curves.append(cur)

oCurves = useful_curves
# ---------- end tol ----------
midpt = CurveMiddle(Curve=tol.oCurves)
filtering = GhPythonScript(iTensions=crv, iTolerance="0.1")  # -> out, oTensions; inputs iTensions: list of Curve
# ---------- filtering: Python ----------
__author__ = "zhanshi"
__version__ = "2023.04.24"

import rhinoscriptsyntax as rs
import Rhino.Geometry as rg

tolerance = iTolerance*0.5*100

#filter curves
useful_curves = []
for cur in iTensions:
        length = cur.GetLength()
        if(length > tolerance):
            useful_curves.append(cur)

oTensions = useful_curves
# ---------- end filtering ----------

# ---- group: SLOW_saving former results
filtering_2 = GhPythonScript(iCompressions=tol.oCurves, iCentroids=midpt, iDif="0.5")  # -> out, oCompressions; inputs iCompressions: list of Curve, iCentroids: list of Point3d; disabled
# ---------- filtering_2: Python ----------
__author__ = "zhanshi"
__version__ = "2023.04.24"

import rhinoscriptsyntax as rs
import Rhino.Geometry as rg

#filter curves
useful_curves = []
for i in range(0, len(iCompressions)):
    pt = iCentroids[i]
    a = 0
    for j in range(0, len(iCompressions)):
        if(j != i):
            pt1 = iCompressions[j].PointAtEnd
            pt2 = iCompressions[j].PointAtStart
            dis1 = pt.DistanceTo(pt1)
            dis2 = pt.DistanceTo(pt2)
            if(dis1 < iDif or dis2 < iDif):
                a = 1
                break
    if(a == 0):
        useful_curves.append(iCompressions[i])

oCompressions = useful_curves
# ---------- end filtering_2 ----------
crv_9 = Curve([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])

# ----
flip = GhPythonScript(iCur=crv_9)  # -> out, oCompressions; inputs iCur: list of Curve
# ---------- flip: Python ----------
__author__ = "zhanshi"
__version__ = "2023.05.11"

import rhinoscriptsyntax as rs
import Rhino.Geometry as rg

list = []

for cur in iCur:
    if(cur.PointAtStart.X<cur.PointAtEnd.X):
        rg.Curve.Reverse(cur)
    list.append(cur)

oCompressions = list
# ---------- end flip ----------

# ---- group: Input data sorting
midpt_2 = CurveMiddle(Curve=filtering.oTensions)
end = EndPoints(Curve=filtering.oTensions)  # -> Start, End
midpt_3 = CurveMiddle(Curve=flip.oCompressions)
end_2 = EndPoints(Curve=flip.oCompressions)  # -> Start, End
vec2pt = Vector2Pt(PointA=end.Start, PointB=end.End, Unitize=False)  # -> Vector, Length
vec2pt_2 = Vector2Pt(PointA=end_2.Start, PointB=end_2.End, Unitize=False)  # -> Vector, Length

# ----
vdisex = VectorDisplayEx(Point=midpt_2, Vector=vec2pt.Vector, Colour=RGBA(0, 0, 255, 162), Width=2)
vdisex_2 = VectorDisplayEx(Point=end_2.Start, Vector=vec2pt_2.Vector, Colour=RGBA(240, 15, 0, 141), Width=2)

# ---- group: Cellular Model
# Cellular Models Polygon
number_slider_4 = Slider(500, range=1..1000)
crv_10 = Curve(rec)
topoly = CurveToPolyline(Curve=crv_10, ToleranceDistance=0, ToleranceAngle=0)  # -> Polyline, Segments
cellularmodel_c = GhPythonScript(
    iPolyline=topoly.Polyline,
    iteration=Slider(8, range=1..20),
    iDiviation=Slider(0.2, range=0..1),
    iCVectors=vec2pt_2.Vector,
    iCLocations=midpt_3,
    iTVectors=vec2pt.Vector,
    iTLocations=midpt_2,
    minHeight=Slider(150, range=1..1000),
    minWidth=Slider(200, range=1..1000),
    maxHeight=number_slider_4,
    maxWidth=Slider(600, range=1..1000),
    iSingleMa=Toggle(True),
    iMaDif=Slider(200, range=1..1000),
    iStaggering=Toggle(False))  # -> out, oResult, oVectors, oMLabels; inputs iPolyline: Polyline, iteration: Int32, iCVectors: list of Vector3d, iCLocations: list of Point3d, iTVectors: list of Vector3d, iTLocations: list of Point3d, iSingleMa: Boolean, iStaggering: Boolean
# ---------- cellularmodel_c: Python ----------
import Rhino.Geometry as rg
import copy

class Cell:
    
    countCells = 0
    countStable = 0
    
    def __init__(self, i, Vertices, Stable):
        self.i = i
        self.vertices = Vertices
        self.Cdiv = None
        self.Tdiv = None
        Cell.countCells += 1
        self.Cforce = None
        self.Tforce = None
        self.CinLength = 0
        self.TinLength = 0
        self.material = True #"P"
        self.shape = rg.PolylineCurve(self.vertices)
        self.stable = Stable
        if(Stable):
            Cell.countStable += 1

    def computeVector(self, iVectors, iLocations, Com):
        if(Com):
            if(self.Cforce is None):
                sumLength = iVectors[0].Length
                sumVec = iVectors[0] * iVectors[0].Length
                for i in xrange(1, len(iVectors)):
                    pt = iLocations[i]
                    if(self.shape.Contains(pt) == rg.PointContainment.Inside):
                        sumLength += iVectors[i].Length
                        sumVec += iVectors[i] * iVectors[i].Length
                self.CinLength = sumLength
                self.Cforce = sumVec / sumLength
            return self.Cforce
        else:
            if(self.Tforce is None):
                sumLength = iVectors[0].Length
                sumVec = iVectors[0] * iVectors[0].Length
                for i in xrange(1, len(iVectors)):
                    pt = iLocations[i]
                    if(self.shape.Contains(pt) == rg.PointContainment.Inside):
                        sumLength += iVectors[i].Length
                        sumVec += iVectors[i] * iVectors[i].Length
                self.TinLength = sumLength
                self.Tforce = sumVec / sumLength
            return self.Tforce
    
    def calculateDiv(self, iVectors, iLocations, Com):
        if(Com):
            if(self.Cdiv is None):
                if(self.Cforce is None):
                    self.computeVector(iVectors, iLocations, Com)
                div = 0
                count = 0
                for i in xrange(len(iLocations)):
                    pt = iLocations[i]
                    if(self.shape.Contains(pt) == rg.PointContainment.Inside):
                        div += rg.Vector3d.VectorAngle(iVectors[i], self.Cforce)
                        count += 1
                if(count == 0):
                    return
                self.Cdiv = div / count
                return div
            else:
                return self.Cdiv
        else:
            if(self.Tdiv is None):
                if(self.Tforce is None):
                    self.computeVector(iVectors, iLocations, Com)
                div = 0
                count = 0
                for i in xrange(len(iLocations)):
                    pt = iLocations[i]
                    if(self.shape.Contains(pt) == rg.PointContainment.Inside):
                        div += rg.Vector3d.VectorAngle(iVectors[i], self.Tforce)
                        count += 1
                if(count == 0):
                    return
                self.Tdiv = div / count
                return div
            else:
                return self.Tdiv
    
    def subdivide(self):
        oriLines = list(self.shape.ToPolyline().GetSegments())
        lines = copy.copy(oriLines)
        def getLength(line):
            return line.Length
        lines.sort(key=getLength)
        line1 = oriLines.index(lines[-1])
        line2 = oriLines.index(lines[-2])
        #avoid triangles
        n = -3
        if(line1 > line2):
            line1, line2 = line2, line1
        print('len', len(lines))
        while((abs(line2-line1) == 1 or (line1 == 0 and line2 == (len(lines)-1)) or (line2 == 0 and line1 == (len(lines)-1))) and abs(n)<=len(lines)):
            line2 = oriLines.index(lines[n])
            n -= 1
        if(line1 > line2):
            line1, line2 = line2, line1
        print(line1, line2)
        list1 = []
        list2 = []
        newPt1 = (self.vertices[line1]+self.vertices[line1+1])*0.5
        if(line2 != (len(lines)-1)):
            newPt2 = (self.vertices[line2]+self.vertices[line2+1])*0.5
        else:
            newPt2 = (self.vertices[line2]+self.vertices[0])*0.5 
        for i in xrange(len(self.vertices)):
            if(i < line1):
                list1.append(self.vertices[i])
            elif(i == line1):
                list1.append(self.vertices[i])
                list1.append(newPt1)
                list2.append(newPt1)
            elif(i > line1 and i < line2):
                list2.append(self.vertices[i])
            elif(i == line2):
                list2.append(self.vertices[i])
                list2.append(newPt2)
                list1.append(newPt2)
            else:
                list1.append(self.vertices[i])
        #list1.append(list1[0])
        list2.append(list2[0])
        print("list", len(list1), len(list2))
        cell1 = Cell(self.i+1, list1, self.stable)
        cell2 = Cell(self.i+1, list2, self.stable)
        result = [cell1, cell2]
        Cell.countCells -= 1
        return result
    
    def isStable(self, maxH, maxW, minH, minW, iDiv):
        if(self.stable):
            return True
        else:
            #Size limitation
            lines = self.shape.ToPolyline().GetSegments()
            if(len(lines) == 4):
                line0 = lines[0]
                line1 = lines[1]
                line2 = lines[2]
                line3 = lines[3]
                height = line0.MinimumDistanceTo(line2)
                width = line1.MinimumDistanceTo(line3)
            else:
                print("lineeee", len(lines))
                """
                print(len(lines))
                box = self.shape.ToPolyline().BoundingBox
                pt1 = box.Corner(True, True, True)
                pt2 = box.Corner(False, False, False)
                height = pt2.Y-pt1.Y
                width = pt2.X-pt1.X
                """
                line0 = lines[0]
                line1 = lines[2]
                line2 = lines[3]
                line3 = lines[4]
                height = line0.MinimumDistanceTo(line2)
                width = line1.MinimumDistanceTo(line3)
                #print(height, width)
            if(height >= maxH or width >= maxW):
                return False
            else:
                #Diviation fulfill?
                if(self.Cdiv <= iDiv and self.Tdiv <= iDiv):
                    self.stable = True
                    Cell.countStable += 1
                    return True
                if(width < minW or height < minH):
                    self.stable = True
                    Cell.countStable += 1
                    return True
                return False
    
    def getForce(self, iSiMa, iMa):
        # if reach iDiviation?
        # if reach size limitation?
        #only one Type of force
        
        if(self.TinLength == 0):
            newForce = self.Cforce
        elif(self.CinLength == 0):
            newForce = self.Tforce
        else:
            sum = self.CinLength + self.TinLength
            newForce = self.Cforce*self.CinLength/sum + self.Tforce*self.TinLength/sum
            print(self.Cforce, self.Tforce)
        if(iSiMa):
            return newForce
        else:
            if(self.Cforce.Length >= self.Tforce.Length):
                if(self.Tforce.Length >= iMa):
                    self.material = False #"C"
            else:
                if(self.Cforce.Length >= iMa):
                    self.material = False #"C"
        return newForce



List = []
vList = []
mList = []
OutList = []



#first cell
ptList = []
segs = iPolyline.GetSegments()

for l in segs:
    cur = l.ToNurbsCurve()
    ptList.append(rg.Point3d(l.PointAt(0).X, l.PointAt(0).Y,l.PointAt(0).Z))
ptList.append(rg.Point3d(segs[0].PointAt(0).X, segs[0].PointAt(0).Y,segs[0].PointAt(0).Z))

cell0 = Cell(0, ptList, False)
List.append(cell0)
cell0.calculateDiv(iCVectors, iCLocations, True)
cell0.calculateDiv(iTVectors, iTLocations, False)

#Iteration
for i in xrange(iteration):
    for j in xrange(len(List)):
        if(List[j].i == (i-1)):
            if(List[j].isStable(maxHeight, maxWidth, minHeight, minWidth, iDiviation)):
                newCell = Cell(List[j].i+1, List[j].vertices, List[j].stable)
                newCell.calculateDiv(iCVectors, iCLocations, True)
                newCell.calculateDiv(iTVectors, iTLocations, False)
                List.append(newCell)
            else:
                newCells = List[j].subdivide()
                newCells[0].calculateDiv(iCVectors, iCLocations, True)
                newCells[0].calculateDiv(iTVectors, iTLocations, False)
                newCells[1].calculateDiv(iCVectors, iCLocations, True)
                newCells[1].calculateDiv(iTVectors, iTLocations, False)
                List.append(newCells[0])
                List.append(newCells[1])
    if(i == iteration-1 or Cell.countCells == Cell.countStable):
        print("ite", i)
        for j in xrange(len(List)):
            if(List[j].i == i):
                OutList.append(List[j].shape)
                vList.append(List[j].getForce(iSingleMa, iMaDif))
                List[j].calculateDiv(iCVectors, iCLocations, True)
                List[j].calculateDiv(iTVectors, iTLocations, False)
                mList.append(List[j].material)
        break

#out
oResult = OutList
oVectors = vList
oMLabels = mList
# ---------- end cellularmodel_c ----------
vec = Vector(cellularmodel_c.oVectors)
crv_11 = Curve(cellularmodel_c.oResult)
area_2 = Area(Geometry=crv_11)  # -> Area, Centroid
vdis_2 = VectorDisplay(Anchor=area_2.Centroid, Vector=vec)
points_2 = PointList(Points=area_2.Centroid, Size=200)

# Cellular Models
number_slider_5 = Slider(700, range=1..1000)
cellularmodel_c_2 = GhPythonScript(
    iCurve=rec,
    iteration=Slider(7, range=1..20),
    iDiviation=Slider(0.2, range=0..1),
    iCVectors=vec2pt_2.Vector,
    iCLocations=midpt_3,
    iTVectors=vec2pt.Vector,
    iTLocations=midpt_2,
    iGetProcess=Toggle(False),
    minSize=Slider(100, range=1..1000),
    maxSize=number_slider_5,
    iSingleMa=Toggle(False),
    iMaDif=Slider(200, range=1..1000))  # -> out, oResult, oVectors, oProcess, oPLabels, oMLabels; inputs iCurve: Rectangle3d, iteration: Int32, iCVectors: list of Vector3d, iCLocations: list of Point3d, iTVectors: list of Vector3d, iTLocations: list of Point3d, iGetProcess: Boolean, iSingleMa: Boolean
# ---------- cellularmodel_c_2: Python ----------
__author__ = "zhanshi"
__version__ = "2023.05.22"

import rhinoscriptsyntax as rs
import Rhino.Geometry as rg

class Cell:
    countCells = 0
    
    def __init__(self, i, width, height, center):
        self.i = i
        self.width = width
        self.height = height
        self.center = center
        self.Cdiv = None
        self.Tdiv = None
        Cell.countCells += 1
        self.Cforce = None
        self.Tforce = None
        self.CinCount = 0
        self.TinCount = 0
        self.material = 'P'
        self.boundingBox = rg.BoundingBox(rg.Point3d(self.center.X - 0.5*self.width, self.center.Y - 0.5*self.height, self.center.Z), rg.Point3d(self.center.X + 0.5*self.width, self.center.Y + 0.5*self.height, self.center.Z))
    
    def calculateDiv(self, iVectors, iLocations, Com):
        if(Com):
            if(self.Cdiv is None):
                if(self.Cforce is None):
                    self.computeVector(iVectors, iLocations, Com)
                div = 0
                count = 0
                for i in range(len(iLocations)):
                    pt = iLocations[i]
                    if(self.boundingBox.Contains(pt)):
                        div += rg.Vector3d.VectorAngle(iVectors[i], self.Cforce)
                        count += 1
                self.Cdiv = div
                self.CinCount = count
                return div
            else:
                return self.Cdiv
        else:
            if(self.Tdiv is None):
                if(self.Tforce is None):
                    self.computeVector(iVectors, iLocations, Com)
                div = 0
                count = 0
                for i in range(len(iLocations)):
                    pt = iLocations[i]
                    if(self.boundingBox.Contains(pt)):
                        div += rg.Vector3d.VectorAngle(iVectors[i], self.Tforce)
                        count += 1
                self.Tdiv = div
                self.TinCount = count
                return div
            else:
                return self.Tdiv
    
    def computeVector(self, iVectors, iLocations, Com):
        if(Com):
            if(self.Cforce is None):
                sumLength = 0
                for i in range(0, len(iVectors)):
                    pt = iLocations[i]
                    if(self.boundingBox.Contains(pt)):
                        sumLength += iVectors[i].Length
                aveVec = iVectors[0] * iVectors[0].Length / sumLength
                for i in range(1, len(iVectors)):
                    pt = iLocations[i]
                    if(self.boundingBox.Contains(pt)):
                        factor = iVectors[i].Length / sumLength
                        aveVec += iVectors[i] * factor
                self.Cforce = aveVec
                return aveVec
            else:
                return self.Cforce
        else:
            if(self.Tforce is None):
                sumLength = 0
                for i in range(0, len(iVectors)):
                    pt = iLocations[i]
                    if(self.boundingBox.Contains(pt)):
                        sumLength += iVectors[i].Length
                aveVec = iVectors[0] * iVectors[0].Length / sumLength
                for i in range(1, len(iVectors)):
                    pt = iLocations[i]
                    if(self.boundingBox.Contains(pt)):
                        factor = iVectors[i].Length / sumLength
                        aveVec += iVectors[i] * factor
                self.Tforce = aveVec
                return aveVec
            else:
                return self.Tforce
    
    def getShape(self):
        return rg.Rectangle3d(rg.Plane(self.center, rg.Vector3d(0,0,1)), rg.Point3d(self.center.X - 0.5*self.width, self.center.Y - 0.5*self.height, self.center.Z), rg.Point3d(self.center.X + 0.5*self.width, self.center.Y + 0.5*self.height, self.center.Z))
    
    def subdivide(self):
        list = []
        if(self.height > self.width):
            newCenter1 = rg.Point3d(self.center.X, self.center.Y - 0.5*0.5*self.height, self.center.Z)
            newCenter2 = rg.Point3d(self.center.X, self.center.Y + 0.5*0.5*self.height, self.center.Z)
            cell1 = Cell(self.i+1, self.width, self.height*0.5, newCenter1)
            cell2 = Cell(self.i+1, self.width, self.height*0.5, newCenter2)
            list.append(cell1)
            list.append(cell2)
        else:
            newCenter1 = rg.Point3d(self.center.X - 0.5*0.5*self.width, self.center.Y, self.center.Z)
            newCenter2 = rg.Point3d(self.center.X + 0.5*0.5*self.width, self.center.Y, self.center.Z)
            cell1 = Cell(self.i+1, self.width*0.5, self.height, newCenter1)
            cell2 = Cell(self.i+1, self.width*0.5, self.height, newCenter2)
            list.append(cell1)
            list.append(cell2)
        return list
    
    def isStable(self):
        if(self.height >= maxSize or self.width >= maxSize):
            return False
        if(self.height >= self.width):
            if(self.height*0.5 < minSize):
                return True
            else:
                return (self.Cdiv <= iDiviation*self.CinCount and self.Tdiv <= iDiviation*self.TinCount)
        else:
            if(self.width*0.5 < minSize):
                return True
            else:
                return (self.Cdiv and self.Tdiv <= iDiviation*self.TinCount)
    
    def getForce(self, iSiMa, iMa):
        # if reach iDiviation?
        # if reach size limitation?
        if(self.Cforce is None):
            self.computeVector(iCVectors, iCLocations, True)
        if(self.Tforce is None):
            self.computeVector(iTVectors, iTLocations, False)
        sum = self.Cforce.Length + self.Tforce.Length
        newForce = self.Cforce*self.Cforce.Length/sum + self.Tforce*self.Tforce.Length/sum 
        if(iSiMa):
            return newForce
        else:
            if(self.Cforce.Length >= self.Tforce.Length):
                if(self.Tforce.Length >= iMa):
                    self.material = 'C'
            else:
                if(self.Cforce.Length >= iMa):
                    self.material = 'C'
            return newForce

List = []
vList = []
mList = []
OutList = []

for i in range(iteration):
    if(Cell.countCells == 0):
        #first cell
        cell0 = Cell(0, iCurve.Width, iCurve.Height, iCurve.Center)
        List.append(cell0)
        cell0.calculateDiv(iCVectors, iCLocations, True)
        cell0.calculateDiv(iTVectors, iTLocations, False)
    else:
        for j in range(len(List)):
            if(List[j].i == (i-1)):
                if(List[j].isStable()):
                    newCell = Cell(List[j].i+1, List[j].width, List[j].height, List[j].center)
                    List.append(newCell)
                else:
                    newCells = List[j].subdivide()
                    newCells[0].calculateDiv(iCVectors, iCLocations, True)
                    newCells[0].calculateDiv(iTVectors, iTLocations, False)
                    newCells[1].calculateDiv(iCVectors, iCLocations, True)
                    newCells[1].calculateDiv(iTVectors, iTLocations, False)
                    List.append(newCells[0])
                    List.append(newCells[1])
    if(i == iteration-1):
        for j in range(len(List)):
            if(List[j].i == i):
                OutList.append(List[j].getShape())
                vList.append(List[j].getForce(iSingleMa, iMaDif))
                mList.append(List[j].material)

oResult = OutList
oVectors = vList
oMLabels = mList

if(iGetProcess):
    list = []
    labels = []
    for i in range(len(List)):
        list.append(List[i].getShape())
        labels.append(List[i].i)
    oProcess = list
    oPLabels = labels
# ---------- end cellularmodel_c_2 ----------
rec_2 = Rectangle(cellularmodel_c_2.oResult)
vec_2 = Vector(cellularmodel_c_2.oVectors)
pcen_2 = PolygonCenter(Polyline=rec_2)  # -> CenterV, CenterE, CenterA
text = Text(Location=pcen_2.CenterV, Text=cellularmodel_c_2.oMLabels, Size=100)
vdis_3 = VectorDisplay(Anchor=pcen_2.CenterV, Vector=vec_2)

# ----
# Rectangle Tiles
srf = Surface(rec)  # disabled
mesh_uv = MeshSurface(Surface=srf, UCount=number_slider_2, VCount=number_slider_3, Overhang=True, Equalize=False)  # disabled
faceb = FaceBoundaries(Mesh=mesh_uv)  # disabled
incurve_2 = PointInCurve(Point=midpt_2, Curve=graft(faceb))  # -> simplify(Relationship), Point; disabled
incurve_3 = PointInCurve(Point=midpt_3, Curve=graft(faceb))  # -> simplify(Relationship), Point; disabled
demesh = DeconstructMesh(Mesh=mesh_uv)  # -> Vertices, Faces, Colours, Normals; disabled
brep = Brep(faceb)  # disabled
points_3 = PointList(Points=demesh.Vertices, Size=50)  # disabled
caverage = GhPythonScript(iPoints=incurve_3.Relationship, iForces=flip.oCompressions, iVectors=vec2pt_2.Vector)  # -> out, flatten(oAveForces), oGroups; inputs iPoints: list of Int32, iForces: list of Curve, iVectors: list of Vector3d; disabled
# ---------- caverage: Python ----------
__author__ = "zhanshi"
__version__ = "2023.04.28"

import rhinoscriptsyntax as rs
import Rhino.Geometry as rg

tempVal = []
tempVec = []

for i in range(0, len(iPoints)):
    if(iPoints[i] == 2):
        tempVal.append(iForces[i])
        tempVec.append(iVectors[i])

if(len(tempVal)>1):
    sumLength = 0
    for i in range(0, len(tempVal)):
        sumLength += tempVal[i].GetLength()
    aveVec = tempVec[0] * tempVal[0].GetLength() / sumLength
    for i in range(1, len(tempVec)):
        factor = tempVal[i].GetLength() / sumLength
        aveVec +=  tempVec[i] * factor
    oAveForces = aveVec
elif(len(tempVal)==1):
    oAveForces = tempVec[0]

oGroups = tempVal
# ---------- end caverage ----------
taverage = GhPythonScript(iPoints=incurve_2.Relationship, iForces=filtering.oTensions, iVectors=vec2pt.Vector)  # -> out, flatten(oAveForces), oGroups; inputs iPoints: list of Int32, iForces: list of Curve, iVectors: list of Vector3d; disabled
# ---------- taverage: Python ----------
__author__ = "zhanshi"
__version__ = "2023.04.28"

import rhinoscriptsyntax as rs
import Rhino.Geometry as rg

tempVal = []
tempVec = []

for i in range(0, len(iPoints)):
    if(iPoints[i] == 2):
        tempVal.append(iForces[i])
        tempVec.append(iVectors[i])

if(len(tempVal)>1):
    sumLength = 0
    for i in range(0, len(tempVal)):
        sumLength += tempVal[i].GetLength()
    aveVec = tempVec[0] * tempVal[0].GetLength() / sumLength
    for i in range(1, len(tempVec)):
        factor = tempVal[i].GetLength() / sumLength
        aveVec +=  tempVec[i] * factor
    oAveForces = aveVec

if(len(tempVal)==1):
    oAveForces = tempVec[0]

oGroups = tempVal
# ---------- end taverage ----------
pcen_3 = PolygonCenter(Polyline=faceb)  # -> CenterV, CenterE, CenterA; disabled
average_2 = GhPythonScript(iDif=panel_3, iTVectors=taverage.oAveForces, iCVectors=caverage.oAveForces)  # -> out, oAveForces; inputs iTVectors: list of Vector3d, iCVectors: list of Vector3d; disabled
# ---------- average_2: Python ----------
__author__ = "zhanshi"
__version__ = "2023.04.28"

import rhinoscriptsyntax as rs
import Rhino.Geometry as rg

tempVec = []

for i in range(0, len(iTVectors)):
    if(iTVectors[i] == None):
        tempVec.append(iCVectors[i])
    elif(iCVectors[i] == None):
        tempVec.append(iTVectors[i])
    else:
        dif= abs(iTVectors[i].Length-iCVectors[i].Length)/(iTVectors[i].Length+iCVectors[i].Length)
        #print(dif)
        if(dif > iDif):
            if(iTVectors[i].Length < iCVectors[i].Length):
                tempVec.append(iCVectors[i])
            else:
                tempVec.append(iTVectors[i])
        else:
            sumLen = iTVectors[i].Length + iCVectors[i].Length
            vec = iTVectors[i]*iTVectors[i].Length/sumLen + iCVectors[i]*iCVectors[i].Length/sumLen 
            tempVec.append(vec)

oAveForces = tempVec
# ---------- end average_2 ----------
vdis_4 = VectorDisplay(Anchor=pcen_3.CenterV, Vector=caverage.oAveForces)  # disabled
points_4 = PointList(Points=pcen_3.CenterV, Size=50)  # disabled
vdis_5 = VectorDisplay(Anchor=pcen_3.CenterV, Vector=taverage.oAveForces)  # disabled
vdis_6 = VectorDisplay(Anchor=pcen_3.CenterV, Vector=average_2.oAveForces)  # disabled
vdisex_3 = VectorDisplayEx(Point=pcen_3.CenterV, Vector=taverage.oAveForces, Colour=RGBA(0, 0, 255, 162), Width=2)  # disabled
vdisex_4 = VectorDisplayEx(Point=pcen_3.CenterV, Vector=caverage.oAveForces, Colour=RGBA(240, 15, 0, 141), Width=2)  # disabled
vdisex_5 = VectorDisplayEx(Point=pcen_3.CenterV, Vector=average_2.oAveForces, Colour=RGBA(3, 170, 0, 162), Width=2)  # disabled

vdisex_6 = VectorDisplayEx(Point=area_2.Centroid, Vector=vec, Colour=RGBA(3, 141, 0, 162), Width=3)

# ---- group: TimbePlates
# Timber Plates
thickness = Slider(27, range=3..100)
Z = UnitZ(Factor=thickness)
extr = Extrude(Base=rec_2, Direction=Z)
cap = CapHoles(Brep=extr)
dim = Dimensions(Surface=rec)  # -> UDimension, VDimension
build = PlateModelBuilder(Breps=cap)  # -> Model, Breps, Sequence, Log
neighbours = NeighboursIDs(Model=build.Model)  # -> Ids, Pairs, Neighbours
getmodules = GhPythonScript(iRec=rec_2, iLength=dim.VDimension, iID=neighbours.Ids)  # -> out, count; inputs iRec: list of Rectangle3d, iID: tree of Int32
# ---------- getmodules: Python ----------
__author__ = "zhanshi"
__version__ = "2023.05.23"

import rhinoscriptsyntax as rs
import Rhino.Geometry as rg
#import ghpythonlib.treehelpers as th

x = []

for i in range(iID.BranchCount):
    x.append(iID.Branch(i))

groups = []

for i in range(len(x)):
    if(abs(iRec[i].Height - iLength) <= 0.01):
        groups.append([i])
    else:
        pt1 = iRec[i].Center
        for j in range(len(x[i])):
            pt2 = iRec[x[i][j]].Center
            if(pt2.Y > pt1.Y and abs(iRec[x[i][j]].Height - iLength) >= 0.01):
                groups.append([i, x[i][j]])
                break

newGroups = []
for i in range(len(groups)):
    if(len(groups[i]) == 1):
        newGroups.append(groups[i])
    else:
        if(i < len(groups)-1):
            if(groups[i][-1] == groups[i+1][-1]):
                newGroups.append([groups[i][0],groups[i+1][0],groups[i][1]])
            else:
                if(len(newGroups) == 0 or newGroups[-1][-1] != groups[i][-1]):
                    newGroups.append(groups[i])
        else:
            if(newGroups[-1][-1] != groups[i][1]):
                newGroups.append(groups[i])

print(newGroups)

count = len(newGroups)
# ---------- end getmodules ----------
sequence = DisplaySequence(breps=build.Breps)

# ---- group: Cellular Model
# Cellular Models (Network Compas)
number_slider_6 = Slider(0.2, range=0..1)  # disabled
number_slider_7 = Slider(8, range=1..20)  # disabled
number_slider_8 = Slider(200, range=1..1000)  # disabled
number_slider_9 = Slider(300, range=1..1000)  # disabled
number_slider_10 = Slider(100, range=1..1000)  # disabled
number_slider_11 = Slider(500, range=1..1000)  # disabled
number_slider_12 = Slider(200, range=1..1000)  # disabled
toggle = BooleanToggle(False)  # disabled
toggle_2 = BooleanToggle(False)  # disabled
toggle_3 = BooleanToggle(False)  # disabled
topoly_2 = CurveToPolyline(Curve=crv_10, ToleranceDistance=0, ToleranceAngle=0)  # -> Polyline, Segments; disabled
cellularmodel_c_3 = GhPythonScript(
    iPolyline=topoly_2.Polyline,
    iteration=number_slider_7,
    iDiviation=number_slider_6,
    iCVectors=vec2pt_2.Vector,
    iCLocations=midpt_3,
    iTVectors=vec2pt.Vector,
    iTLocations=midpt_2,
    iGetProcess=toggle_3,
    minHeight=number_slider_10,
    minWidth=number_slider_8,
    maxHeight=number_slider_9,
    maxWidth=number_slider_11,
    iSingleMa=toggle,
    iMaDif=number_slider_12,
    iStaggering=toggle_2)  # -> out, oResult, oVectors, oProcess, oPLabels, oMLabels; inputs iPolyline: Polyline, iteration: Int32, iCVectors: list of Vector3d, iCLocations: list of Point3d, iTVectors: list of Vector3d, iTLocations: list of Point3d, iGetProcess: Boolean, iSingleMa: Boolean, iStaggering: Boolean; disabled
# ---------- cellularmodel_c_3: Python ----------
__author__ = "zhanshi"
__version__ = "2023.05.22"

import rhinoscriptsyntax as rs
import Rhino.Geometry as rg
from compas.geometry import Point, Polygon
import compas.geometry as cg


class Cell:
    
    countCells = 0
    
    def __init__(self, i, Vertices):
        self.i = i
        self.vertices = Vertices
        self.Cdiv = None
        self.Tdiv = None
        Cell.countCells += 1
        self.Cforce = None
        self.Tforce = None
        self.CinCount = 0
        self.TinCount = 0
        self.material = 'P'
        self.shape = Polygon(Vertices)
        self.box = cg.bounding_box_xy(self.vertices)
        self.width = self.box[1][0]-self.box[0][0]
        self.height = self.box[3][1]-self.box[0][1]
    
    def calculateDiv(self, iVectors, iLocations, Com):
        if(Com):
            if(self.Cdiv is None):
                if(self.Cforce is None):
                    self.computeVector(iVectors, iLocations, Com)
                div = 0
                count = 0
                for i in range(len(iLocations)):
                    pt = Point(iLocations[i].X, iLocations[i].Y, iLocations[i].Z)
                    if(cg.is_point_in_polygon_xy(pt, self.shape)):
                        div += rg.Vector3d.VectorAngle(iVectors[i], self.Cforce)
                        count += 1
                self.Cdiv = div
                self.CinCount = count
                return div
            else:
                return self.Cdiv
        else:
            if(self.Tdiv is None):
                if(self.Tforce is None):
                    self.computeVector(iVectors, iLocations, Com)
                div = 0
                count = 0
                for i in range(len(iLocations)):
                    pt = Point(iLocations[i].X, iLocations[i].Y, iLocations[i].Z)
                    if(cg.is_point_in_polygon_xy(pt, self.shape)):
                        div += rg.Vector3d.VectorAngle(iVectors[i], self.Tforce)
                        count += 1
                self.Tdiv = div
                self.TinCount = count
                return div
            else:
                return self.Tdiv
    
    def computeVector(self, iVectors, iLocations, Com):
        if(Com):
            if(self.Cforce is None):
                sumLength = 0
                for i in range(0, len(iVectors)):
                    pt = [iLocations[i].X, iLocations[i].Y, iLocations[i].Z]
                    if(cg.is_point_in_polygon_xy(pt, self.shape)):
                        sumLength += iVectors[i].Length
                aveVec = iVectors[0] * iVectors[0].Length / sumLength
                for i in range(1, len(iVectors)):
                    pt = [iLocations[i].X, iLocations[i].Y, iLocations[i].Z]
                    if(cg.is_point_in_polygon_xy(pt, self.shape)):
                        factor = iVectors[i].Length / sumLength
                        aveVec += iVectors[i] * factor
                self.Cforce = aveVec
                return aveVec
            else:
                return self.Cforce
        else:
            if(self.Tforce is None):
                sumLength = 0
                for i in range(0, len(iVectors)):
                    pt = [iLocations[i].X, iLocations[i].Y, iLocations[i].Z]
                    if(cg.is_point_in_polygon_xy(pt, self.shape)):
                        sumLength += iVectors[i].Length
                aveVec = iVectors[0] * iVectors[0].Length / sumLength
                for i in range(1, len(iVectors)):
                    pt = [iLocations[i].X, iLocations[i].Y, iLocations[i].Z]
                    if(cg.is_point_in_polygon_xy(pt, self.shape)):
                        factor = iVectors[i].Length / sumLength
                        aveVec += iVectors[i] * factor
                self.Tforce = aveVec
                return aveVec
            else:
                return self.Tforce
    
    
    def subdivide(self):
        lines = self.shape.lines
        line1 = 0
        length1 = lines[0].length
        line2 = 0
        length2 = lines[0].length
        for i in range(len(lines)):
            if(lines[i].length >= length1):
                line1 = i
                length1 = lines[i].length
        for i in range(len(lines)):
            if(lines[i].length >= length2 and i != line1):
                line2 = i
                length2 = lines[i].length
        if(line1>line2):
            temp = line1
            line1 = line2
            line2 = temp
        list1 = []
        list2 = []
        newPt1 = (self.vertices[line1]+self.vertices[line1+1])*0.5
        if(line2 != (len(lines)-1)):
            newPt2 = (self.vertices[line2]+self.vertices[line2+1])*0.5
        else:
            newPt2 = (self.vertices[line2]+self.vertices[0])*0.5
        for i in range(len(self.vertices)):
            if(i < line1):
                list1.append(self.vertices[i])
            elif(i == line1):
                list1.append(self.vertices[i])
                list1.append(newPt1)
                list2.append(newPt1)
            elif(i > line1 and i < line2):
                list2.append(self.vertices[i])
            elif(i == line2):
                list2.append(self.vertices[i])
                list2.append(newPt2)
                list1.append(newPt2)
            else:
                list1.append(self.vertices[i])
        cell1 = Cell(self.i+1, list1)
        cell2 = Cell(self.i+1, list2)
        result = [cell1, cell2]
        return result
    
    def isStable(self):
        if(self.height >= maxHeight or self.width >= maxWidth):
            return False
        if(self.height > self.width):
            return False
        else:
            if(self.width*0.5 < minWidth or self.height*0.5 < minHeight):
                return True
            else:
                return (self.Cdiv <= iDiviation*self.CinCount and self.Tdiv <= iDiviation*self.TinCount)
    
    def getForce(self, iSiMa, iMa):
        # if reach iDiviation?
        # if reach size limitation?
        if(self.Cforce is None):
            self.computeVector(iCVectors, iCLocations, True)
        if(self.Tforce is None):
            self.computeVector(iTVectors, iTLocations, False)
        sum = self.Cforce.Length + self.Tforce.Length
        newForce = self.Cforce*self.Cforce.Length/sum + self.Tforce*self.Tforce.Length/sum 
        if(iSiMa):
            return newForce
        else:
            if(self.Cforce.Length >= self.Tforce.Length):
                if(self.Tforce.Length >= iMa):
                    self.material = 'C'
            else:
                if(self.Cforce.Length >= iMa):
                    self.material = 'C'
            return newForce

List = []
vList = []
mList = []
OutList = []

for i in range(iteration):
    if(Cell.countCells == 0):
        #first cell
        pList = []
        segs = iPolyline.GetSegments()
        for s in segs:
            pList.append(Point(s.PointAt(0).X,s.PointAt(0).Y,s.PointAt(0).Z))
        cell0 = Cell(0, pList)
        List.append(cell0)
        cell0.calculateDiv(iCVectors, iCLocations, True)
        cell0.calculateDiv(iTVectors, iTLocations, False)
    else:
        for j in range(len(List)):
            if(List[j].i == (i-1)):
                if(List[j].isStable()):
                    newCell = Cell(List[j].i+1, List[j].vertices)
                    List.append(newCell)
                else:
                    newCells = List[j].subdivide()
                    newCells[0].calculateDiv(iCVectors, iCLocations, True)
                    newCells[0].calculateDiv(iTVectors, iTLocations, False)
                    newCells[1].calculateDiv(iCVectors, iCLocations, True)
                    newCells[1].calculateDiv(iTVectors, iTLocations, False)
                    List.append(newCells[0])
                    List.append(newCells[1])
    if(i == iteration-1):
        for j in range(len(List)):
            if(List[j].i == i):
                OutList.append(List[j].shape)
                vList.append(List[j].getForce(iSingleMa, iMaDif))
                mList.append(List[j].material)

oResult = OutList
oVectors = vList
oMLabels = mList

if(iGetProcess):
    list = []
    labels = []
    for i in range(len(List)):
        artist = PolygonArtist(List[i].shape)
        list.append(List[i].shape)
        labels.append(List[i].i)
    oProcess = list
    oPLabels = labels
# ---------- end cellularmodel_c_3 ----------
vec_3 = Vector(cellularmodel_c_3.oVectors)  # disabled
draw = Draw(cg=cellularmodel_c_3.oResult)  # -> flatten(rg); disabled
#   port cg: The COMPAS geometry or datastructure to be drawn.
#   port rg: The Rhino geometry object.
# ---------- draw: Python ----------
"""
Draws COMPAS geometry in Grasshopper.
"""
from ghpythonlib.componentbase import executingcomponent as component

from compas.artists import Artist


class CompasToRhinoGeometry(component):
    def RunScript(self, cg):
        if not cg:
            return None

        return Artist(cg).draw()
# ---------- end draw ----------
text_2 = Text(Location=cellularmodel_c_3.oMLabels, Text=cellularmodel_c_3.oMLabels, Size=100)  # disabled
vdis_7 = VectorDisplay(Vector=vec_3)  # disabled

# ---- group: Tile optimation
# Adaptive Tiling
panel_8 = Panel("0.1")  # disabled
tile_addition = GhPythonScript(iTiles=brep, iVectors=average_2.oAveForces, iDiv=panel_8, Y=number_slider_3)  # -> out, oTiles, oVectors; inputs iTiles: list of Brep, iVectors: list of Vector3d, Y: Int32; disabled
# ---------- tile_addition: Python ----------
__author__ = "zhanshi"
__version__ = "2023.04.28"

import rhinoscriptsyntax as rs
import Rhino.Geometry as rg
import ghpythonlib.treehelpers as th
import copy

count = []
newTiles = []
newVectors = []
groups = []

for i in range(0, len(iTiles)):
    count.append(False)

"""
#DataTree from GH to list
x = th.tree_to_list(iGroups)
for i,branch in enumerate(x):
    for j,item in enumerate(branch):
        groups.append(item)
"""

#addition
for i in range(0, len(iTiles)):
    if((i+Y)<len(iTiles)):
        if(count[i] == False):
            vector1 = iVectors[i]
            vector2 = iVectors[i+Y]
            angle = rg.Vector3d.VectorAngle(vector1, vector2)
            print(angle)
            if(angle < iDiv):
                count[i+Y] = True
                list = [iTiles[i], iTiles[i+Y]]
                newBrep = rg.Brep.MergeSurfaces(iTiles[i], iTiles[i+Y],0.1,0.0)
                newTiles.append(newBrep)
                newVector = rg.Vector3d.Add(iVectors[i], iVectors[i+Y])*0.5
                newVectors.append(newVector)
            else:
                newTiles.append(iTiles[i])
                newVectors.append(iVectors[i])
    else:
        newTiles.append(iTiles[i])
        newVectors.append(iVectors[i])

oTiles = newTiles
oVectors = newVectors
# ---------- end tile_addition ----------
faceb_2 = FaceBoundaries(Mesh=tile_addition.oTiles)  # disabled
brep_2 = Brep(faceb_2)  # disabled
incurve_4 = PointInCurve(Point=midpt_2, Curve=graft(brep_2))  # -> simplify(Relationship), Point; disabled
incurve_5 = PointInCurve(Point=midpt_3, Curve=graft(brep_2))  # -> simplify(Relationship), Point; disabled
faceb_3 = FaceBoundaries(Mesh=brep_2)  # -> flatten(Boundaries); disabled
pcen_4 = PolygonCenter(Polyline=faceb_3)  # -> CenterV, CenterE, CenterA; disabled
grouping = GhPythonScript(iPoints=incurve_4.Relationship, iForces=filtering.oTensions)  # -> out, oGroups; inputs iPoints: list of Int32, iForces: list of Curve; disabled
# ---------- grouping: Python ----------
__author__ = "zhanshi"
__version__ = "2023.04.28"

import rhinoscriptsyntax as rs
import Rhino.Geometry as rg

tempVal = []
tempVec = []

for i in range(0, len(iPoints)):
    if(iPoints[i] == 2):
        tempVal.append(iForces[i])

oGroups = tempVal
# ---------- end grouping ----------
grouping_2 = GhPythonScript(iPoints=incurve_5.Relationship, iForces=flip.oCompressions)  # -> out, oGroups; inputs iPoints: list of Int32, iForces: list of Curve; disabled; same code as grouping
panel_9 = Panel("1.1")  # disabled
tile_subdivition = GhPythonScript(
    iPoints=pcen_4.CenterV,
    iTiles=flatten(brep_2),
    iVectors=tile_addition.oVectors,
    iTGroups=grouping.oGroups,
    iCGroups=grouping_2.oGroups,
    iDiv=panel_9,
    Y=number_slider_3)  # -> out, oTiles, oVectors; inputs iPoints: list of Point3d, iTiles: list of Brep, iVectors: list of Vector3d, iTGroups: tree of Curve, iCGroups: tree of Curve, Y: Int32; disabled
# ---------- tile_subdivition: Python ----------
__author__ = "zhanshi"
__version__ = "2023.04.28"

import rhinoscriptsyntax as rs
import Rhino.Geometry as rg
import ghpythonlib.treehelpers as th
import copy

count = []
newTiles = []
newVectors = []
Tgroups = []
Cgroups = []

for i in range(0, len(iPoints)):
    count.append(False)

#DataTree from GH to nested list
x = th.tree_to_list(iTGroups)
for i in range(len(x)):
    gr = []
    for j in range(len(x[i])):
        gr.append(x[i][j])
    Tgroups.append(gr)

y = th.tree_to_list(iCGroups)
for i in range(len(y[0])):
    gr = []
    for j in range(len(y[0][i])):
        gr.append(y[0][i][j])
    Cgroups.append(gr)

print(len(Cgroups))

#subdivition
for i in range(len(Cgroups)):
    Cdif = 0
    Tdif = 0
    for j in range(len(Cgroups[i])):
        curve = Cgroups[i][j]
        angle = rg.Vector3d.VectorAngle(curve.TangentAtStart,iVectors[i])
        Cdif += (angle / len(Cgroups[i]))
    for j in range(len(Tgroups[i])):
        curve = Tgroups[i][j]
        angle = rg.Vector3d.VectorAngle(curve.TangentAtStart,iVectors[i])
        Tdif += (angle / len(Tgroups[i]))
    if(Cdif > iDiv or Tdif > iDiv):
        #subtiles
        newTilesList = []
        for j in range(4):
            newTilesList.append(copy.deepcopy(iTiles[i]))
        for j in range(4):
            tr = rg.Transform.Scale(iTiles[i].Vertices[j].Location, 0.5)
            rg.Brep.Transform(newTilesList[j], tr)
            newTilesVectors = []
        #find closest orientation for sub tiles ???
        for j in range(4):
            dis = Tgroups[i][0].PointAt(0.5).DistanceTo(iTiles[i].Vertices[j].Location)
            index = 0
            for k in range(len(Tgroups[i])):
                ptdis = Tgroups[i][k].PointAt(0.5).DistanceTo(iTiles[i].Vertices[j].Location)
                if(ptdis<dis):
                    dis = ptdis
                    index = k
        pt1 = Tgroups[i][index].PointAtStart
        pt2 = Tgroups[i][index].PointAtEnd
        newTilesVectors.append(rg.Vector3d(pt1.X-pt2.X,pt1.Y-pt2.Y,pt1.Z-pt2.Z))
        #output
        for j in range(4):
            newTiles.append(newTilesList[j])
            newVectors.append(newTilesVectors[0])
    else:
        newTiles.append(iTiles[i])
        newVectors.append(iVectors[i])

oTiles = newTiles
oVectors = newVectors
# ---------- end tile_subdivition ----------
vdis_8 = VectorDisplay(Anchor=pcen_4.CenterV, Vector=tile_addition.oVectors)  # disabled
brep_3 = Brep(tile_subdivition.oTiles)  # disabled
pcen_5 = PolygonCenter(Polyline=brep_3)  # -> CenterV, CenterE, CenterA; disabled
faceb_4 = FaceBoundaries(Mesh=brep_3)  # disabled
vdis_9 = VectorDisplay(Anchor=pcen_5.CenterV, Vector=tile_subdivition.oVectors)  # disabled
points_5 = PointList(Points=pcen_5.CenterV, Size=25)  # disabled

# ----
faceb_5 = FaceBoundaries(Mesh=brep_3)  # -> flatten(Boundaries); disabled

# ---- group: Extra input tiles
# External Input
einstein_tile_2 = Curve([<curve referenced from the Rhino model> x118])  # disabled
end_3 = EndPoints(Curve=flip.oCompressions)  # -> Start, End; disabled
end_4 = EndPoints(Curve=filtering.oTensions)  # -> Start, End; disabled
incurve_6 = PointInCurve(Point=midpt_3, Curve=graft(faceb_5))  # -> simplify(Relationship), Point; disabled
incurve_7 = PointInCurve(Point=midpt_2, Curve=graft(faceb_5))  # -> simplify(Relationship), Point; disabled
vec2pt_3 = Vector2Pt(PointA=end_3.Start, PointB=end_3.End, Unitize=False)  # -> Vector, Length; disabled
vec2pt_4 = Vector2Pt(PointA=end_4.Start, PointB=end_4.End, Unitize=False)  # -> Vector, Length; disabled
caverage_2 = GhPythonScript(iPoints=incurve_6.Relationship, iForces=flip.oCompressions, iVectors=vec2pt_3.Vector)  # -> out, flatten(oAveForces); inputs iPoints: list of Int32, iForces: list of Curve, iVectors: list of Vector3d; disabled; same code as taverage
taverage_2 = GhPythonScript(iPoints=incurve_7.Relationship, iForces=filtering.oTensions, iVectors=vec2pt_4.Vector)  # -> out, flatten(oAveForces); inputs iPoints: list of Int32, iForces: list of Curve, iVectors: list of Vector3d; disabled; same code as taverage
average_3 = GhPythonScript(iTForces=taverage_2.oAveForces, iTiles=faceb_5, iCForces=caverage_2.oAveForces, iDif=panel_2)  # -> out, oTiles, oAveForces; inputs iTForces: list of Vector3d, iTiles: list of Curve, iCForces: list of Vector3d; disabled
# ---------- average_3: Python ----------
__author__ = "zhanshi"
__version__ = "2023.04.28"

import rhinoscriptsyntax as rs
import Rhino.Geometry as rg

tempGeo = []
tempVec = []

for i in range(0, len(iTiles)):
    if((iTForces[i] != None) and (iCForces[i] != None)):
        dif= abs(iTForces[i].Length-iCForces[i].Length)/(iTForces[i].Length+iCForces[i].Length)
        if(dif > iDif):
            if(iTForces[i].Length < iCForces[i].Length):
                tempVec.append(iCForces[i])
            else:
                tempVec.append(iTForces[i])
        else:
            sumLen = iTForces[i].Length + iCForces[i].Length
            vec = iTForces[i]*iTForces[i].Length/sumLen + iCForces[i]*iCForces[i].Length/sumLen 
            tempVec.append(vec)
        tempGeo.append(iTiles[i])
    elif((iTForces[i] == None) and (iCForces[i] != None)):
        tempGeo.append(iTiles[i])
        tempVec.append(iCForces[i])
    elif((iTForces[i] != None) and (iCForces[i] == None)):
        tempGeo.append(iTiles[i])
        tempVec.append(iTForces[i])

oTiles = tempGeo
oAveForces = tempVec
# ---------- end average_3 ----------
pcen_6 = PolygonCenter(Polyline=average_3.oTiles)  # -> CenterV, CenterE, CenterA; disabled

# ----
vdis_10 = VectorDisplay(Anchor=pcen_6.CenterV, Vector=caverage_2.oAveForces)  # disabled
vdis_11 = VectorDisplay(Anchor=pcen_6.CenterV, Vector=taverage_2.oAveForces)  # disabled
vdisex_7 = VectorDisplayEx(Point=pcen_6.CenterV, Vector=caverage_2.oAveForces, Colour=RGBA(240, 15, 0, 141), Width=2)  # disabled
vdisex_8 = VectorDisplayEx(Point=pcen_6.CenterV, Vector=taverage_2.oAveForces, Colour=RGBA(0, 0, 255, 162), Width=2)  # disabled
vdisex_9 = VectorDisplayEx(Point=pcen_6.CenterV, Vector=average_3.oAveForces, Colour=RGBA(3, 170, 0, 162), Width=2)  # disabled

# ---- group: FingerJoints
# Joints generation
# -Inputs:
# Thickness
# Tagetted joints
# Finger Joints
build_2 = PlateModelBuilder(Run=True, Breps=cap, Sequence=getmodules.out)  # -> Model, Breps, Sequence, Log
number_slider_13 = Slider(15, range=0..100)
number_slider_14 = Slider(3, range=0..100)
number_slider_15 = Slider(10, range=0..100)
finger = AddFingerJoint(
    Model=build_2.Model,
    Finger_number_1=number_slider_14,
    Finger_length_1=number_slider_15,
    Finger_width_1=number_slider_13,
    Finger_number_2=number_slider_14,
    Finger_length_2=number_slider_15,
    Finger_width_2=number_slider_13,
    Finger_spacing=Slider(0, range=0..100),
    Finger_shift=Slider(0, range=0..100),
    Mirror=True)  # -> Model, Joints_positives, Joints_negatives, Joints_keys

# ----
extr_2 = Extrude(Base=crv_10, Direction=Z)

# ----
# Scarf Joints
number_slider_16 = Slider(30, range=1..180)
extr_3 = Extrude(Base=crv_11, Direction=Z)
findcofaces = GhPythonScript(iBoundary=extr_2, iBreps=extr_3, iAngle=number_slider_16, iThickness=thickness)  # -> oUpCurves, oBuCurves; inputs iBoundary: Brep, iBreps: list of Brep
# ---------- findcofaces: Python ----------
__author__ = "zhanshi"
__version__ = "2023.06.01"
        

import rhinoscriptsyntax as rs
import Rhino.Geometry as rg
import math
import copy

class Plates:
                
    countPlates = 0
            
    def __init__(self, brep):
        self.shape = brep
        self.id = Plates.countPlates
        Plates.countPlates += 1
        self.neibours = []
        self.coFaces = []
        self.isShifted = [] ##shifted
        
oBreps = []
myList = []

#find neighbours
for b in iBreps:
    myList.append(Plates(b))
    for v in myList[-1].shape.Vertices:
        myList[-1].isShifted.append(False)
if(Plates.countPlates>1):
    for i in xrange(Plates.countPlates):
        for j in xrange(Plates.countPlates):
            if(j != i):
                iFaces = myList[i].shape.Faces
                a = iFaces.GetEnumerator()
                count = 0
                while(count < iFaces.Count):
                    aFace = next(a)
                    aBox = aFace.GetBoundingBox(False)
                    num = 0
                    jFaces = myList[j].shape.Faces
                    b = jFaces.GetEnumerator()
                    while(num<jFaces.Count):
                        bBox = next(b).GetBoundingBox(False)
                        if(aBox.Contains(bBox) or bBox.Contains(aBox)):
                            if(len(myList[i].neibours) == 0):
                                myList[i].neibours.append(j)
                                myList[i].coFaces.append(count)
                            elif(myList[i].neibours[-1] != j):
                                myList[i].neibours.append(j)
                                myList[i].coFaces.append(count)
                        num += 1
                    count += 1

#for b in myList:
    #print(b.neibours, b.id, b.coFaces)

#find vertices of faces and shift in the direction of WOrldXY

for b in myList:#shift points on edge
    vList = b.shape.Vertices
    for iFace in iBoundary.Faces:# Find points on edge
        for V in vList:
            pt = V.Location
            if(pt.Z >= (iThickness - 1)):
                p = iFace.PointAt(iFace.ClosestPoint(pt)[1], iFace.ClosestPoint(pt)[2])
                dis = p.DistanceTo(pt)
                if(dis <= 1):
                    check = False # check if on other surfaces(Corner Points)
                    for face in iBoundary.Faces:
                        if(face.FaceIndex != iFace.FaceIndex):
                            p2 = face.PointAt(face.ClosestPoint(pt)[1], face.ClosestPoint(pt)[2])
                            dis2 = p2.DistanceTo(pt)
                            if(dis2 <= 1):
                                check = True
                                break
                    if(check == False):
                        vector = rg.Vector3d(1,1,0)
                        for e in iBoundary.Edges:
                            cPt = e.PointAt(e.ClosestPoint(pt)[1])
                            d = pt.DistanceTo(cPt)
                            if(d <= 0.1):
                                if(e.PointAtEnd.X > e.PointAtStart.X or e.PointAtEnd.Y > e.PointAtStart.Y):
                                    vector = rg.Vector3d(e.PointAtEnd-e.PointAtStart)
                                else:
                                    vector = rg.Vector3d(e.PointAtStart-e.PointAtEnd)
                                vector.Unitize()
                                vector *= iThickness / math.tan(math.radians(iAngle))
                                break
                        V.Transform(rg.Transform.Translation(vector))
                        b.isShifted[V.VertexIndex] = True

for b in myList:#shift points inside
    vList = b.shape.Vertices
    for f in b.coFaces:
        face = b.shape.Faces[f]
        box = face.GetBoundingBox(False)
        #box.Transform(rg.Transform.Scale(box.Center, 1.01))
        for v in vList:
            # if neibour
            if(b.isShifted[v.VertexIndex] == False):
                if(v.Location.Z >= (iThickness - 1) and box.Contains(v.Location)):#find upper inside vertex
                    vector = rg.Vector3d(iThickness / math.tan(math.radians(iAngle)), iThickness / math.tan(math.radians(iAngle)), .0)
                    v.Transform(rg.Transform.Translation(vector))
                    b.isShifted[v.VertexIndex] = True

#new Paths
newList = []
for b in myList:
    upList = []
    buList = []
    for i in range(b.shape.Vertices.Count):
        if(b.shape.Vertices[i].Location.Z > 1):
            upList.append(b.shape.Vertices[i].Location)
        else:
            buList.append(b.shape.Vertices[i].Location)
    upList.append(upList[0])
    buList.append(buList[0])
    buList.reverse()
    upPolyline = rg.Polyline(upList)
    buPolyline = rg.Polyline(buList)
    newList.append([upPolyline, buPolyline])

oUpCurves = []
oBuCurves = []
for b in newList:
    oUpCurves.append(b[0])
    oBuCurves.append(b[1])

#a = myList[0].shape.Vertices
# ---------- end findcofaces ----------
explode = Explode(Curve=findcofaces.oBuCurves, Recursive=True)  # -> Segments, Vertices
explode_2 = Explode(Curve=findcofaces.oUpCurves, Recursive=True)  # -> Segments, Vertices
area_3 = Area(Geometry=findcofaces.oUpCurves)  # -> Area, Centroid
end_5 = EndPoints(Curve=explode_2.Segments)  # -> Start, End
end_6 = EndPoints(Curve=explode.Segments)  # -> Start, End
rulesrf = RuledSurface(CurveA=explode_2.Segments, CurveB=explode.Segments)
cap_2 = CapHoles(Brep=extr_3)
join = BrepJoin(Breps=rulesrf)  # -> Breps, Closed
points_6 = PointList(Points=end_5.Start, Size=50)
points_7 = PointList(Points=end_6.Start, Size=50)
cap_3 = CapHoles(Brep=join.Breps)

cap_4 = CapHoles(Brep=extr_2)
build_3 = PlateModelBuilder(Breps=cap_3)  # -> Model, Breps, Sequence, Log
brep_4 = Brep(build_3.Breps)

# ---- group: Assembly
# Assembly sequence: define modules in Mains
# Assembly Sequence
toggle_4 = BooleanToggle(True)
number_slider_17 = Slider(21, range=0..21)
# - Bugs: Numbering differ from assembly sequence
merge = MergeJointsWithPlates(Run=toggle_4, Model=finger.Model, Bool_tol=1, Merge_tol=1)  # -> Model, Breps
sequence_2 = DisplaySequence(breps=merge.Breps)
deci = SplitDecimals(Num=counter_2)  # -> Int, Deci
modules = GetModules(Model=merge.Model, Module_id=deci.Int)  # -> Module, Sequence, Step, Breps
anim = AnimateSequence(Model=modules.Module, Step=deci.Deci, Retreat=Slider(10, range=0..10))  # -> Breps, Status

# ---- group: Nesting
Y = UnitY(Factor=1)
cluster = Cluster(A=vec_2, B_2=Y, B=merge.Breps)  # -> A_2, brep_2, pt_2
rot3d = Rotate3D(Geometry=cluster.brep_2, Angle=cluster.A_2, Center=cluster.pt_2, Axis=Vector(0, 0, 1))  # -> Geometry, Transform
project = Project(Polyline=rot3d.Geometry)  # -> Polyline, Plane
pcen_7 = PolygonCenter(Polyline=project.Polyline)  # -> CenterV, CenterE, CenterA
pack = PackObjects(Geo=rot3d.Geometry, Plane=project.Plane, X=1, Y=1, Tolerabce=0)  # -> Geo, Transformation
points_8 = PointList(Points=pcen_7.CenterV, Size=100)
pcen_8 = PolygonCenter(Polyline=pack.Geo)  # -> CenterV, CenterE, CenterA
points_9 = PointList(Points=pcen_8.CenterV, Size=50)
opennest = OpenNest(
    Sheets=crv_8,
    Geo=pack.Geo,
    Spacing=Slider(20, range=0..100),
    Placement=Slider(10, range=0..20),
    Tolerance=Slider(0.2, range=0..19),
    Rotations=1,
    Iterations=Slider(8, range=0..20),
    Seed=Slider(5, range=0..20),
    Reset=True,
    Run=False)  # -> Sheets, Geo, ID, Transform, IDS
pcen_9 = PolygonCenter(Polyline=opennest.Geo)  # -> CenterV, CenterE, CenterA
points_10 = PointList(Points=pcen_9.CenterV, Size=100)

# ---- group: TimbePlates
material_thickness = Slider(27, range=3..100)
brep_5 = Brep(opennest.Geo)
Z_2 = UnitZ(Factor=material_thickness)
extr_4 = Extrude(Base=brep_5, Direction=Z_2)
cap_5 = CapHoles(Brep=extr_4)
build_4 = PlateModelBuilder(Breps=cap_5)  # -> Model, Breps, Sequence, Log
sequence_3 = DisplaySequence(breps=build_4.Breps)

# ----
brec = BoundingRectangle(Geometry=opennest.Geo, Plane=PlaneXY(0, 0, 0), Axis=0, Slide=0, Union=True)  # -> Bounding, DimensionX, DimensionY
crv_12 = Curve(opennest.Sheets)

# ---- group: CNC-cutpath
# Cutting Path for CNC
number_slider_18 = Slider(0.2, range=0.01..0.3)
toggle_5 = BooleanToggle(True)
toolpath = ToolpathGenerator(
    Model=build_4.Model,
    Contour_tool_radius=number_slider_18,
    Holes_tool_radius=Slider(0.1, range=0.1..0.2),
    Notch=toggle_5,
    Cylinder=toggle_5,
    Tbone=Toggle(True))  # -> Model, Top_milling_contour, Bottom_milling_contour, Top_milling_holes, Bottom_milling_holes
number_slider_19 = Slider(0.1, range=0..0.1)  # disabled
number_slider_20 = Slider(0.01, range=0..0.01)  # disabled
toggle_6 = BooleanToggle(True)  # disabled
joints = PlateJoints(Model=toolpath.Model)  # -> Joints_positives, Joints_negatives, Joints_keys; disabled
milling_contours = MillingContours(Model=toolpath.Model)  # -> Top_milling_contour, Bottom_milling_contour, Top_milling_holes, Bottom_milling_holes; disabled
merge_2 = MergeJointsWithPlates(Run=toggle_6, Model=toolpath.Model, Bool_tol=number_slider_20, Merge_tol=number_slider_19)  # -> Model, Breps; disabled
sequence_4 = DisplaySequence(breps=merge_2.Breps)  # disabled

# ---- group: CNC-cutpath / text
brep_6 = Brep(build_4.Breps)  # disabled
area_4 = Area(Geometry=brep_6)  # -> Area, Centroid; disabled
index = ItemIndex(List=area_4.Centroid, Item=area_4.Centroid)  # disabled
text_3 = Text(Location=area_4.Centroid, Text=index, Size=100)  # disabled

# ---- group: Force oriented
# Thrust Line Oriented
crv_13 = Curve([<curve referenced from the Rhino model> x269])  # disabled
intens = PointInCurve(Point=midpt_2, Curve=graft(crv_13))  # -> simplify(Relationship), Point; disabled
incompr = PointInCurve(Point=midpt_3, Curve=graft(crv_13))  # -> simplify(Relationship), Point; disabled
taverage_3 = GhPythonScript(iPoints=intens.Relationship, iForces=filtering.oTensions, iVectors=vec2pt_4.Vector)  # -> out, flatten(oAveForces); inputs iPoints: list of Int32, iForces: list of Curve, iVectors: list of Vector3d; disabled; same code as taverage
caverage_3 = GhPythonScript(iPoints=incompr.Relationship, iForces=flip.oCompressions, iVectors=vec2pt_3.Vector)  # -> out, flatten(oAveForces); inputs iPoints: list of Int32, iForces: list of Curve, iVectors: list of Vector3d; disabled; same code as taverage
pcen_10 = PolygonCenter(Polyline=crv_13)  # -> CenterV, CenterE, CenterA; disabled
pcen_11 = PolygonCenter(Polyline=crv_13)  # -> CenterV, CenterE, CenterA; disabled
vdis_12 = VectorDisplay(Anchor=pcen_11.CenterV, Vector=caverage_3.oAveForces)  # disabled
vdis_13 = VectorDisplay(Anchor=pcen_10.CenterV, Vector=taverage_3.oAveForces)  # disabled
average_4 = GhPythonScript(iAveTForces=taverage_3.oAveForces, iTiles=crv_13, iAveCForces=caverage_3.oAveForces)  # -> out, oTiles, oAveForces; inputs iAveTForces: list of Vector3d, iTiles: list of Curve, iAveCForces: list of Vector3d; disabled
# ---------- average_4: Python ----------
__author__ = "zhanshi"
__version__ = "2023.04.28"

import rhinoscriptsyntax as rs
import Rhino.Geometry as rg

tempGeo = []
tempVec = []
tempPt = []

for i in range(0, len(iTiles)):
    if((iAveTForces[i] != None) and (iAveCForces[i] != None)):
        tempGeo.append(iTiles[i])
        vec = rg.Vector3d.Add(iAveTForces[i], iAveCForces[i])
        tempVec.append(vec)
    elif((iAveTForces[i] == None) and (iAveCForces[i] != None)):
        tempGeo.append(iTiles[i])
        tempVec.append(iAveCForces[i])
    elif((iAveTForces[i] != None) and (iAveCForces[i] == None)):
        tempGeo.append(iTiles[i])
        tempVec.append(iAveTForces[i])

oTiles = tempGeo
oAveForces = tempVec
oPoints = tempPt
# ---------- end average_4 ----------
vdis_14 = VectorDisplay(Anchor=pcen_11.CenterV, Vector=average_4.oAveForces)  # disabled
perpenticular = Curve([<curve referenced from the Rhino model> x152])  # disabled
pcen_12 = PolygonCenter(Polyline=average_4.oTiles)  # -> CenterV, CenterE, CenterA; disabled
parallel = Curve([<curve referenced from the Rhino model> x117])  # disabled
midpt_4 = CurveMiddle(Curve=parallel)  # disabled
midpt_5 = CurveMiddle(Curve=perpenticular)  # disabled
average_5 = GhPythonScript(iAveForces=average_4.oAveForces, iTiles=pcen_12.CenterV, iPaCurves=midpt_4, iPeCurves=midpt_5)  # -> out, oPaForces, oPeForces; inputs iAveForces: list of Vector3d, iTiles: list of Point3d, iPaCurves: list of Point3d, iPeCurves: list of Point3d; disabled
# ---------- average_5: Python ----------
__author__ = "zhanshi"
__version__ = "2023.04.28"

import rhinoscriptsyntax as rs
import Rhino.Geometry as rg

tempCur1 = []

for i in range(0, len(iPaCurves)):
    for j in range(0, len(iTiles)):
        if(iPaCurves[i].DistanceTo(iTiles[j])<1):
            tempCur1.append(iAveForces[j])
            break

oPaForces = tempCur1

tempCur2 = []

for i in range(0, len(iPeCurves)):
    for j in range(0, len(iTiles)):
        if(iPeCurves[i].DistanceTo(iTiles[j])<1):
            tempCur2.append(iAveForces[j])
            break

oPeForces = tempCur2
# ---------- end average_5 ----------
vdis_15 = VectorDisplay(Anchor=midpt_5, Vector=average_5.oPeForces)  # disabled
X = UnitX(Factor=1)  # disabled
X_2 = UnitX(Factor=1)  # disabled

# ----
vdisex_10 = VectorDisplayEx(Point=pcen_11.CenterV, Vector=average_4.oAveForces, Colour=RGBA(3, 170, 0, 162), Width=2)  # disabled
previewlw = CustomPreviewLineweights(
    Geometry=[parallel, perpenticular],
    Shader={diffuse=RGB(255, 105, 180), emission=RGB(76, 32, 54), shine=0.5, specular=RGB(255, 255, 255), transparency=0},
    Thickness=0.1,
    Absolute=True)  # disabled
rev = Reverse(Vector=X)  # disabled
rev_2 = Reverse(Vector=X_2)  # disabled
angle = Angle(VectorA=average_5.oPaForces, VectorB=rev)  # -> Angle, Reflex; disabled

# ---- group: Force oriented (continued)
rotate = RotateDirection(Geometry=perpenticular, Center=midpt_5, From=rev_2, To=average_5.oPeForces)  # -> Geometry, Transform; disabled
rotate_2 = RotateDirection(Geometry=parallel, Center=midpt_4, From=rev, To=average_5.oPaForces)  # -> Geometry, Transform; disabled

# ----
deg = Degrees(Radians=angle.Angle)  # disabled
angle_2 = Angle(VectorA=rotate.Geometry, VectorB=perpenticular)  # -> Angle, Reflex; disabled
deg_2 = Degrees(Radians=angle_2.Angle)  # disabled
max = GhPythonScript(iList=deg)  # -> maxA, maxI, minA, minI, aver; inputs iList: list; disabled
# ---------- max: Python ----------
__author__ = "zhanshi"
__version__ = "2023.06.06"

import rhinoscriptsyntax as rs
import math

sum = 0
count = 0
min = iList[0]
max = 0

for i in iList:
    print(i)
    if (i > max):
        max = i
        maxI = count
    if(i < min):
        min = i
        minI = count
    count += 1
    sum += i

maxA = max
minA = min
aver = sum / count
# ---------- end max ----------
panel_10 = Panel(deg)  # disabled
panel_11 = Panel(deg_2)  # disabled
max_2 = GhPythonScript(iList=deg_2)  # -> maxA, maxI, minA, minI, aver; inputs iList: list; disabled; same code as max
panel_12 = Panel([max_2.maxA, max_2.maxI, max_2.minA, max_2.minI, max_2.aver])  # disabled
panel_13 = Panel([max.maxA, max.maxI, max.minA, max.minI, max.aver])  # disabled
item = ListItem(List=rotate.Geometry, Index=max_2.minI, Wrap=True)  # disabled
item_2 = ListItem(List=rotate_2.Geometry, Index=max.maxI, Wrap=True)  # disabled
item_3 = ListItem(List=rotate_2.Geometry, Index=max.minI, Wrap=True)  # disabled
item_4 = ListItem(List=rotate.Geometry, Index=max_2.maxI, Wrap=True)  # disabled

# ---- group: Result recording
# Results Evaluation
area_5 = Area(Geometry=brec.Bounding)  # -> Area, Centroid
area_6 = Area(Geometry=opennest.Sheets)  # -> Area, Centroid
lng = ListLength(List=area_6.Area)
item_5 = ListItem(List=area_6.Area, Index=0, Wrap=True)
multiplication = Multiplication(A=item_5, B=lng)

# ----
x_minus_one = XMinusOne(NumberX=lng)
multiplication_2 = Multiplication(A=area.Area, B=x_minus_one)
subtraction = Subtraction(A=area_5.Area, B=multiplication_2)

# ---- group: Result recording (continued)
division = Division(A=subtraction, B=multiplication)
rec_3 = DataRecorder(division, DataLimit=-10, RecordData=True)
panel_14 = Panel(rec_3)

# ==== cluster DisplaySequence: Display a colorful assembly sequence.
breps = ClusterInput()  # Plate as Brep

# ---- group: Brep
dom = ConstructDomain(DomainStart=Slider(0, range=0..1), DomainEnd=Slider(0.3, range=0..1))
lng = ListLength(List=breps)
range = Range(Domain=dom, Steps=lng)
hsl = ColourHSL(Alpha=Slider(0.26, range=0..1), Hue=range, Saturation=Slider(1, range=0..1), Luminance=Slider(0.6, range=0..1))
preview = CustomPreview(Geometry=breps, Material=hsl)

# ---- group: Text
area = Area(Geometry=breps)  # -> Area, Centroid
index = ItemIndex(List=breps, Item=breps)
pl = ConstructPlane(Origin=area.Centroid, XAxis=Vector(1, 0, 0), YAxis=Vector(0, 0, 1))
sqrt = SquareRoot(Value=area.Area)
division = Division(A=sqrt, B=10)
tag = TextTag3D(Location=pl, Text=index, Size=division, Colour=ColourSwatch(SwatchColor=RGB(0, 0, 0)), Justification=5)

# ==== cluster Cluster
B = ClusterInput()
debrep = DeconstructBrep(Brep=B)  # -> Faces, Edges, Vertices
area = Area(Geometry=debrep.Faces)  # -> Area, Centroid
pdecon = Deconstruct(Point=area.Centroid)  # -> XComponent, YComponent, ZComponent
sort = SortList(Keys=pdecon.ZComponent, ValuesA=debrep.Faces)  # -> Keys, ValuesA
item = ListItem(List=sort.ValuesA, Index=0, Wrap=True)  # -> flatten(Item)
brep = Brep(item)
pcen = PolygonCenter(Polyline=brep)  # -> CenterV, CenterE, CenterA
brep_2 = ClusterOutput(brep)
pt = Point(pcen.CenterA)
pl = ConstructPlane(Origin=pt, XAxis=Vector(1, 0, 0), YAxis=Vector(0, 1, 0))
A = ClusterInput()
B_2 = ClusterInput()
pt_2 = ClusterOutput(pt)
angle = Angle(VectorA=A, VectorB=B_2, Plane=pl)  # -> Angle, Reflex
A_2 = ClusterOutput(angle.Angle)
